# Grasshopper definition 0000mass_and_collisions.gh (Grasshopper 0.9.75)
# plug-ins: Kangaroo Components

# Try choosing different
# values here for the mass of
# the projectile and re-running
# the simulation.
list = ValueList({"0.1", "1", "10", "100"}, selected="10")
pt = Point(Point(4, 5, 0))
pt_2 = Point([Point(35.88332692, 23.92422086, 0), Point(32.43555951, 17.95740868, 0), Point(24.33332411, 15.5106314, 0), Point(34.34681565, 18.93478979, 0), Point(23.05504001, 17.37931376, 0), Point(26.61454774, 23.26649168, 0)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])
inter = InterconnectPoints(Pts=flatten([pt, pt_2]))
# This component can be used to set
# custom masses for particles. If no custom
# mass is set, all particles have a default
# mass of 1kg.
# Note that mass is separate from weight
# due to gravity (gravity is not applied by
# default, and would have to be added as
# a separate force).
# Mass is the property that affects how
# much force is needed to accelerate a
# particle, in accordance with Newton's
# 2nd law.
particle = Particle(Point=pt, Mass=list, Velocity=Vector(8, 5, 0))
# The cutoff setting is used for simulating
# collisions between spheres. See
# examples in the "Collisions" folder for
# more examples.
multiplication = Multiplication(A="1", B="0.5")
springs = SpringsFromLine(Connection=inter, Stiffness=1000, Damping=10, RestLength="1", UpperCutoff="1", LowerCutoff=0, Plasticity=0)
kangaroo_settings = KangarooSettings(
    Tolerance=0.001,
    TimeStep=0.01,
    SubIterations=10,
    Floor=False,
    Drag="0.01",
    Restitution=0.7,
    StaticFriction=10,
    KineticFriction=10,
    Settle=2,
    Tumble=1,
    Sound=False,
    Solver=0)

# ----
# The button is an alternative to the
# Boolean toggle as a way of running the
# simulation. It just needs to be pressed
# once to restart the simulation.
# 
# The timer component causes the
# simulation to continuously iterate.
timer = Timer(TimerInterval=20, Target=kangaroo)  # disabled

# ----
# You can also double-click the Kangaroo
# component itself to bring up a remote
# control timer, which replaces the need for
# the Reset button and timer components.
kangaroo = KangarooPhysics(ForceObjects=[springs, particle], Settings=kangaroo_settings, SimulationReset=Button())  # -> Out, Iterations, ParticlesOut, GeometryOut
cir = Circle(Plane=kangaroo.ParticlesOut, Radius=multiplication)
