# Grasshopper definition 0010_SingleParticle.gh (Grasshopper 0.9.75)
# plug-ins: Kangaroo Components

# Particles can be given a starting velocity.
# If there is no drag, they will continue moving,
# in accordance with Newton's 1st law.
panel = Panel("10")
X = UnitX(Factor=panel)
pt = Point(Point(15, 0, 15))
particle = Particle(Point=pt, Mass=1, Velocity=X)
kangaroo_settings = KangarooSettings(
    Tolerance=0.001,
    TimeStep=0.01,
    SubIterations=10,
    Floor=False,
    Drag="0",
    Restitution=0.7,
    StaticFriction=10,
    KineticFriction=10,
    Settle=2,
    Tumble=1,
    Sound=False,
    Solver=0)

timer = Timer(TimerInterval=20, Target=kangaroo)  # disabled

kangaroo = KangarooPhysics(ForceObjects=particle, Settings=kangaroo_settings, SimulationReset=Toggle(False))  # -> Out, Iterations, ParticlesOut, GeometryOut
