# Grasshopper definition 0020_unary_force.gh (Grasshopper 0.9.75)
# plug-ins: Kangaroo Components

X = UnitX(Factor="10")
pt = Point(Point(15, 0, 15))
Z = UnitZ(Factor="-10")
kangaroo_settings = KangarooSettings(
    Tolerance=0.001,
    TimeStep=0.01,
    SubIterations=10,
    Floor=Toggle(True),
    Drag=0.2,
    Restitution=0.7,
    StaticFriction=10,
    KineticFriction=10,
    Settle=2,
    Tumble=1,
    Sound=False,
    Solver=0)
uforce = UnaryForce(Point=pt, Force=Z)
particle = Particle(Point=pt, Mass=1, Velocity=X)

timer = Timer(TimerInterval=20, Target=kangaroo)  # disabled

kangaroo = KangarooPhysics(ForceObjects=[particle, uforce], Settings=kangaroo_settings, SimulationReset=Toggle(True))  # -> Out, Iterations, ParticlesOut, GeometryOut
