# Grasshopper definition 0030_unary_force2.gh (Grasshopper 0.9.75)
# plug-ins: Kangaroo Components

# By changing this 2d slider, you can
# control the strength and direction of the
# force which is accelerating the particle.
md_slider = MDSlider(
    slider_value=Point(0.493902439, 0.512195122, 0.5),
    SliderMode=0,
    x_domain=Domain(-1, 1),
    y_domain=Domain(-1, 1),
    z_domain=Domain(0, 1))
pt = Point(Point(15, 0, 15))

timer = Timer(TimerInterval=1, Target=kangaroo)  # disabled

particle = Particle(Point=pt, Mass=1, Velocity=Vector(0, 0, 0))
uforce = UnaryForce(Point=pt, Force=md_slider)
kangaroo = KangarooPhysics(ForceObjects=[uforce, particle], Settings=null, SimulationReset=Toggle(True))  # -> Out, Iterations, ParticlesOut, GeometryOut
