# Grasshopper definition 0040floordemo.gh (Grasshopper 0.9.61)
# plug-ins: Kangaroo Components

Z = UnitZ(Factor="-10")
pt = Point(Point(6.644136698, 0, 17.73695623))
kangaroo_settings = KangarooSettings(
    Tolerance=0.001,
    TimeStep=0.01,
    SubIterations=10,
    Floor=Toggle(True),
    Drag=0,
    Restitution=1,
    StaticFriction=10,
    KineticFriction=10,
    Settle=2,
    Tumble=1,
    Sound=False,
    Solver=0)
uforce = UnaryForce(Point=pt, Force=Z)
timer = Timer(TimerInterval=20, Target=kangaroo)  # disabled
kangaroo = KangarooPhysics(ForceObjects=uforce, Settings=kangaroo_settings, SimulationReset=Button())  # -> Out, Iterations, ParticlesOut, GeometryOut
