# Grasshopper definition 0045attraction_and_repulsion.gh (Grasshopper 0.9.61)
# plug-ins: Kangaroo Components

# Negative strength is an attraction force
# (it tries to reduce the distance between
# the particles)
# Positive strength is a repulsion force
# (it tries to increase the distance between
# the particles)
panel = Panel("-1")
point = Point(Point(6, 7, 0))
point_2 = Point(Point(15, 15, 0))
ln = Line(StartPoint=point_2, EndPoint=point)
plaw = PowerLaw(Connection=ln, Exponents=0, Strength=panel, Cutoff=0)
timer = Timer(TimerInterval=20, Target=kangaroo)  # disabled
kangaroo = KangarooPhysics(ForceObjects=plaw, Settings=null, SimulationReset=Button())  # -> Out, Iterations, ParticlesOut, GeometryOut
