# Grasshopper definition 0046orbit.gh (Grasshopper 0.9.75)
# plug-ins: Kangaroo Components

pt = Point(Point(5, 4, 0))
pt_2 = Point(Point(5, 11, 0))
particle = Particle(Point=pt_2, Mass="1", Velocity=Vector(3.02569282, 0.7311900574, 0))
ln = Line(StartPoint=pt, EndPoint=pt_2)
particle_2 = Particle(Point=pt, Mass="100000", Velocity=Vector(0, 0, 0))
kangaroo_settings = KangarooSettings(
    Tolerance=0.001,
    TimeStep=0.01,
    SubIterations=10,
    Floor=False,
    Drag="0.01",
    Restitution=0.7,
    StaticFriction=10,
    KineticFriction=10,
    Settle=2,
    Tumble=1,
    Sound=False,
    Solver=0)
plaw = PowerLaw(Connection=ln, Exponents=-2, Strength=-100, Cutoff=0)
button = Button()
kangaroo = KangarooPhysics(ForceObjects=[particle_2, particle, plaw], Settings=kangaroo_settings, SimulationReset=button)  # -> Out, Iterations, ParticlesOut, GeometryOut
# If drag is greater than 0, the planet spirals
#  in towards the sun.
# Also note, if you zoom right in towards the
#  sun, you can see that it also moves a
# tiny amount, due to the pull of the planet
#  (equal and opposite forces). It moves
# less because it has much higher mass.
timer = Timer(TimerInterval=20, Target=kangaroo)  # disabled
T = Trail(Points=kangaroo.ParticlesOut, Reset=button, Record=True)
