# Grasshopper definition 0050Orbits.gh (Grasshopper 0.9.61)
# plug-ins: Kangaroo Components

X = UnitX(Factor="0.5")
X_2 = UnitX(Factor="1")
pt = Point(Point(10, 20, 0))
pt_2 = Point(Point(10, 15, 0))
pt_3 = Point(Point(10, 10, 0))
kangaroo_settings = KangarooSettings(
    Tolerance=0.001,
    TimeStep=0.01,
    SubIterations=10,
    Floor=False,
    Drag="0",
    Restitution=0.7,
    StaticFriction=10,
    KineticFriction=10,
    Settle=2,
    Tumble=1,
    Sound=False,
    Solver=0)
particle = Particle(Point=pt_2, Mass="1", Velocity=X_2)
particle_2 = Particle(Point=pt_3, Mass="100000", Velocity="0,0,0")
particle_3 = Particle(Point=pt, Mass="1", Velocity=X)
ln = Line(StartPoint=[pt_2, pt], EndPoint=pt_3)
plaw = PowerLaw(Connection=ln, Exponents="-2", Strength=-10, Cutoff=0)

button = Button()
timer = Timer(TimerInterval=20, Target=kangaroo)  # disabled

kangaroo = KangarooPhysics(ForceObjects=flatten([particle_3, particle, particle_2, plaw]), Settings=kangaroo_settings, SimulationReset=button)  # -> Out, Iterations, ParticlesOut, GeometryOut
T = Trail(Points=kangaroo.ParticlesOut, Reset=button, Record=True)
