# Grasshopper definition 0060threebody.gh (Grasshopper 0.9.75)
# plug-ins: Kangaroo Components

pt = Point([Point(12.94569964, 5.083198933, 0), Point(22.49828791, 19.40234641, 0), Point(8.334008886, 24.26116438, 0)])
inter = InterconnectPoints(Pts=pt)
plaw = PowerLaw(Connection=inter, Exponents=-2, Strength=-100, Cutoff=0)
kangaroo_settings = KangarooSettings(
    Tolerance=0.001,
    TimeStep=0.0001,
    SubIterations=500,
    Floor=False,
    Drag=0,
    Restitution=0.7,
    StaticFriction=10,
    KineticFriction=10,
    Settle=2,
    Tumble=1,
    Sound=False,
    Solver=0)
button = Button()
timer = Timer(TimerInterval=1, Target=kangaroo)  # disabled
# Remember - Kangaroo simulations will
# run faster when the Grasshopper window
# is minimized.
kangaroo = KangarooPhysics(ForceObjects=plaw, Settings=kangaroo_settings, SimulationReset=button)  # -> Out, Iterations, ParticlesOut, GeometryOut
T = Trail(Points=kangaroo.ParticlesOut, Reset=button, Record=True)
preview = CustomPreview(
    Geometry=T,
    Shader=[ColourSwatch(SwatchColor=RGB(255, 0, 0)), ColourSwatch(SwatchColor=RGB(0, 255, 34)), ColourSwatch(SwatchColor=RGB(8, 0, 255))])
