# Grasshopper definition 0070powerlaw_and_anchor.gh (Grasshopper 0.9.75)
# plug-ins: Kangaroo Components

ey = ExtentY(30)
sqgrid = Square(Plane=PlaneXY(0, 0, 0), Size=1, ExtentX=ey, ExtentY=ey)  # -> Cells, Points

# ---- group: reference a point in from Rhino
pt = Point(<point referenced from the Rhino model>)

# ----
pt_2 = Point(flatten(sqgrid.Points))
kangaroo_settings = KangarooSettings(
    Tolerance=0.001,
    TimeStep=0.01,
    SubIterations=10,
    Floor=False,
    Drag="0.1",
    Restitution=0.7,
    StaticFriction=10,
    KineticFriction=10,
    Settle=2,
    Tumble=1,
    Sound=False,
    Solver=0)
# Try moving the anchored point while the
# simulation is running, to attract the cloud
# of particles. (If you reference the point by
# Type=Point, then you can move it in Rhino,
# or if you reference it by Type=Coordinate,
# you can select it in Grasshopper and move
# it with the GH Gumball)
ln = Line(StartPoint=pt, EndPoint=pt_2)
plaw = PowerLaw(Connection=ln, Exponents="-1", Strength="-10", Cutoff=0)

timer = Timer(TimerInterval=1, Target=kangaroo)  # disabled

kangaroo = KangarooPhysics(ForceObjects=flatten(plaw), AnchorPoints=pt, Settings=kangaroo_settings, SimulationReset=Button())  # -> Out, Iterations, ParticlesOut, GeometryOut
