# Grasshopper definition 0071springs_and_gravity.gh (Grasshopper 0.9.75)
# plug-ins: Kangaroo Components

crv = Curve([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])
len = Length(Curve=crv)
# Here the length of each bar is multiplied
# by a density value to apply a
# proportional load to each end node (half to each).
multiplication = Multiplication(A=len, B=Slider(0.208, range=0..1))
explode = Explode(Curve=crv, Recursive=True)  # -> Segments, Vertices
end = EndPoints(Curve=crv)  # -> Start, End
Z = UnitZ(Factor=multiplication)
rev = Reverse(Vector=Z)
springs = SpringsFromLine(
    Connection=explode.Segments,
    Stiffness=2000,
    Damping=10,
    RestLength=explode.Segments,
    UpperCutoff=0,
    LowerCutoff=0,
    Plasticity=0)
multiplication_2 = Multiplication(A=rev, B="0.5")
uforce = UnaryForce(Point=[end.Start, end.End], Force=rev)

timer = Timer(TimerInterval=1, Target=kangaroo)  # disabled

pt = Point([Point(-8, 0, 0), Point(16, 0, 0)])
kangaroo = KangarooPhysics(
    ForceObjects=flatten([springs, uforce]),
    AnchorPoints=pt,
    Settings=null,
    Geometry=explode.Segments,
    SimulationReset=Toggle(True))  # -> Out, Iterations, ParticlesOut, GeometryOut
