# Grasshopper definition 0075hangingchain1.gh (Grasshopper 0.9.75)
# plug-ins: Kangaroo Components

# Remember to look in Front view in Rhino!
# 
# Gravity is acting in the Z direction, so we
# won't see much in Top view.
crv = Curve(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)

# ----
# Breaking the curve into
# many short segments
divide = DivideCurve(Curve=crv, Count=10, Kinks=False)  # -> Points, Tangents, Parameters
shatter = Shatter(Curve=crv, Parameters=divide.Parameters)

end = EndPoints(Curve=crv)  # -> Start, End

# ---- group: applying gravity
Z = UnitZ(Factor="-10")
uforce = UnaryForce(Point=divide.Points, Force=Z)

# ----
# Note that the segments are stretching.
# Higher stiffness values reduce the
# amount of stretching which occurs.
springs = SpringsFromLine(Connection=shatter, Stiffness="100", Damping=10, RestLength=shatter, UpperCutoff=0, LowerCutoff=0, Plasticity=0)

timer = Timer(TimerInterval=20, Target=kangaroo)  # disabled

kangaroo = KangarooPhysics(
    ForceObjects=flatten([springs, uforce]),
    AnchorPoints=[end.Start, end.End],
    Settings=null,
    Geometry=shatter,
    SimulationReset=Toggle(False))  # -> Out, Iterations, ParticlesOut, GeometryOut
