# Grasshopper definition 0080catenarymesh.gh (Grasshopper 0.9.75)
# plug-ins: Kangaroo Components

# ---- group: some input flat mesh
mesh = Mesh([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])

# ----
clean = CombineClean(Meshes=mesh)
corners = Corners(mesh=clean)
# These are GH user objects. More can be
# found under the Kangaroo Utilities tab, to
# simplify the use of common collections of
# forces.
# 
# They appear and can be used like
# components, but they can also be exploded
#  by double clicking to see their internal
# workings.
springsfrommesh = SpringsFromMesh(M=clean, stiffness=1000, B=1)
gravity = Gravity(M=clean, F="10")

timer = Timer(TimerInterval=1, Target=kangaroo)  # disabled

# ----
# Note the flattening of Force objects input
kangaroo = KangarooPhysics(
    ForceObjects=flatten([springsfrommesh, gravity]),
    AnchorPoints=corners,
    Settings=null,
    Geometry=clean,
    SimulationReset=Button())  # -> Out, Iterations, ParticlesOut, GeometryOut
mesh_2 = Mesh(kangaroo.GeometryOut)

# ==== cluster SpringsFromMesh: Turns all edges of a mesh into springs
M = ClusterInput()
medges = MeshEdges(Mesh=M)  # -> NakedEdges, InteriorEdges, NonManifoldEdges
crv = Curve([medges.NakedEdges, medges.InteriorEdges])
B = ClusterInput()
len = Length(Curve=crv)
multiplication = Multiplication(A=len, B=B)
stiffness = ClusterInput()
springs = SpringsFromLine(Connection=crv, Stiffness=stiffness, Damping=10, RestLength=multiplication, UpperCutoff=0, LowerCutoff=0, Plasticity=0)
S = ClusterOutput(springs)

# ==== cluster Gravity: Apply gravity to vertices of a mesh
M = ClusterInput()
F = ClusterInput()
mcomp = Decompose(Mesh=M)  # -> Vertices, Faces, Colours, Normals
Z = UnitZ(Factor=F)
duppt = RemoveDuplicatePts(Points=mcomp.Vertices, Tolerance=0.01)
uforce = UnaryForce(Point=duppt, Force=Z)
U = ClusterOutput(uforce)

# ==== cluster Corners: Find the boundary corner points of a quad mesh
mesh = ClusterInput()
mesh_2 = Mesh(mesh)
nv = NakedVertices(Mesh=mesh_2)  # -> ClothedIndex, NakedIndex, ClothedPts, NakedPts
vn = VertexNeighbours(Mesh=mesh_2, VertexNumber=nv.NakedIndex)  # -> graft(Vertex), Neighbours, Normal
lng = ListLength(List=vn.Neighbours)
equals = Equality(FirstNumber=lng, SecondNumber=3)  # -> Equality, Inequality
cull = CullPattern(List=vn.Vertex, CullPattern=equals.Inequality)
pshift = ShiftPaths(Data=cull, Offset=-1)
D = ClusterOutput(pshift)
