# Grasshopper definition 0090pull_to_curve.gh (Grasshopper 0.9.75)
# plug-ins: Kangaroo Components

number_slider = Slider(1, range=0.1..5)
pop2d = Populate2D(Region={Plane=PlaneXY(2, 4, 0), Size=Domain2(u=0..29, v=0..23)}, Count=100, Seed=1)
crv = Curve(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)
inter = InterconnectPoints(Pts=pop2d)
springs = SpringsFromLine(
    Connection=inter,
    Stiffness=1000,
    Damping=10,
    RestLength=number_slider,
    UpperCutoff=number_slider,
    LowerCutoff=0,
    Plasticity=0)
curvepull = CurvePull(Curve=crv, Points=pop2d, Strength=100)
multiplication = Multiplication(A=number_slider, B="0.5")

timer = Timer(TimerInterval=20, Target=kangaroo)  # disabled

kangaroo = KangarooPhysics(ForceObjects=flatten([curvepull, springs]), Settings=null, SimulationReset=Button())  # -> Out, Iterations, ParticlesOut, GeometryOut
cir = Circle(Plane=kangaroo.ParticlesOut, Radius=multiplication)
