# Grasshopper definition 0083tensile_mesh1.gh (Grasshopper 0.9.61)
# plug-ins: Kangaroo Components

mesh = Mesh(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)
clean = CombineClean(Meshes=mesh)
quaddiv = QuadDivide(Mesh=clean, Divisions=5)
springsfrommesh = SpringsFromMesh(M=quaddiv, stiffness=1000, B=Slider(0, range=0..1))
nv = NakedVertices(Mesh=quaddiv)  # -> ClothedIndex, NakedIndex, ClothedPts, NakedPts

timer = Timer(TimerInterval=20, Target=kangaroo)  # disabled

kangaroo = KangarooPhysics(ForceObjects=springsfrommesh, AnchorPoints=nv.NakedPts, Settings=null, Geometry=quaddiv, SimulationReset=Toggle(True))  # -> Out, Iterations, ParticlesOut, GeometryOut
mesh_2 = Mesh(kangaroo.GeometryOut)

# ==== cluster SpringsFromMesh: Turns all edges of a mesh into springs
M = ClusterInput()
medges = MeshEdges(Mesh=M)  # -> NakedEdges, InteriorEdges, NonManifoldEdges
crv = Curve([medges.NakedEdges, medges.InteriorEdges])
B = ClusterInput()
len = Length(Curve=crv)
multiplication = Multiplication(A=len, B=B)
stiffness = ClusterInput()
springs = SpringsFromLine(Connection=crv, Stiffness=stiffness, Damping=10, RestLength=multiplication, UpperCutoff=0, LowerCutoff=0, Plasticity=0)
S = ClusterOutput(springs)
