# Grasshopper definition 0084tensile_mesh_cables.gh (Grasshopper 0.9.61)
# plug-ins: Kangaroo Components

mesh = Mesh(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)
clean = CombineClean(Meshes=mesh)
medges = MeshEdges(Mesh=clean)  # -> NakedEdges, InteriorEdges, NonManifoldEdges
crv = Curve([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])
springs = SpringsFromLine(
    Connection=[medges.NakedEdges, crv],
    Stiffness=3000,
    Damping=10,
    RestLength=0,
    UpperCutoff=0,
    LowerCutoff=0,
    Plasticity=0)
springsfrommesh = SpringsFromMesh(M=clean, stiffness=100, B=Slider(0, range=0..1))
pt = Point([Point(10, 10, 0), Point(10, 15, 8), Point(10, 20, 0), Point(20, 30, 0), Point(25, 30, 8), Point(30, 30, 0), Point(40, 10, 0), Point(40, 15, 8), Point(40, 20, 0)])

timer = Timer(TimerInterval=20, Target=kangaroo)  # disabled

kangaroo = KangarooPhysics(
    ForceObjects=flatten([springsfrommesh, springs]),
    AnchorPoints=pt,
    Settings=null,
    Geometry=clean,
    SimulationReset=Toggle(True))  # -> Out, Iterations, ParticlesOut, GeometryOut
mesh_2 = Mesh(kangaroo.GeometryOut)

# ==== cluster SpringsFromMesh: Turns all edges of a mesh into springs
M = ClusterInput()
medges = MeshEdges(Mesh=M)  # -> NakedEdges, InteriorEdges, NonManifoldEdges
crv = Curve([medges.NakedEdges, medges.InteriorEdges])
B = ClusterInput()
len = Length(Curve=crv)
multiplication = Multiplication(A=len, B=B)
stiffness = ClusterInput()
springs = SpringsFromLine(Connection=crv, Stiffness=stiffness, Damping=10, RestLength=multiplication, UpperCutoff=0, LowerCutoff=0, Plasticity=0)
S = ClusterOutput(springs)
