# Grasshopper definition 0092tensile_mesh_pull_curve.gh (Grasshopper 0.9.61)
# plug-ins: Kangaroo Components

mesh = Mesh(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)
crv = Curve(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)
pt = Point([Point(15, 5, 20), Point(15, 7, 20), Point(15, 9, 20), Point(15, 11, 20), Point(15, 13, 20), Point(15, 15, 20), Point(17, 5, 20), Point(17, 15, 20), Point(19, 5, 20), Point(19, 15, 20), Point(21, 5, 20), Point(21, 15, 20), Point(23, 5, 20), Point(23, 15, 20), Point(25, 5, 20), Point(25, 7, 20), Point(25, 9, 20), Point(25, 11, 20), Point(25, 13, 20), Point(25, 15, 20)])
clean = CombineClean(Meshes=mesh)
curvepull = CurvePull(Curve=crv, Points=pt, Strength=1000)
quaddiv = QuadDivide(Mesh=clean, Divisions=5)
pt_2 = Point([Point(5, 5, 0), Point(5, 5, 2), Point(5, 5, 4), Point(5, 5, 6), Point(5, 5, 8), Point(5, 5, 10), Point(5, 7, 0), Point(5, 7, 10), Point(5, 9, 0), Point(5, 9, 10)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])
springsfrommesh = SpringsFromMesh(M=quaddiv, stiffness=100, B=Slider(0, range=0..1))

timer = Timer(TimerInterval=20, Target=kangaroo)  # disabled

kangaroo = KangarooPhysics(
    ForceObjects=flatten([springsfrommesh, curvepull]),
    AnchorPoints=pt_2,
    Settings=null,
    Geometry=quaddiv,
    SimulationReset=Toggle(False))  # -> Out, Iterations, ParticlesOut, GeometryOut
mesh_2 = Mesh(kangaroo.GeometryOut)

# ==== cluster SpringsFromMesh: Turns all edges of a mesh into springs
M = ClusterInput()
medges = MeshEdges(Mesh=M)  # -> NakedEdges, InteriorEdges, NonManifoldEdges
crv = Curve([medges.NakedEdges, medges.InteriorEdges])
B = ClusterInput()
len = Length(Curve=crv)
multiplication = Multiplication(A=len, B=B)
stiffness = ClusterInput()
springs = SpringsFromLine(Connection=crv, Stiffness=stiffness, Damping=10, RestLength=multiplication, UpperCutoff=0, LowerCutoff=0, Plasticity=0)
S = ClusterOutput(springs)
