# Grasshopper definition 0095true_minimal_surface.gh (Grasshopper 0.9.61)
# plug-ins: Kangaroo Components

mesh = Mesh(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)

# ---- group: analytically generated catenoid for comparison
C = Slider(6, range=0..10)
neg = Negative(Value=C)
dom = ConstructDomain(DomainStart=neg, DomainEnd=C)
N = Steps(200)
N_2 = Steps(100)
range = Range(Domain=Domain(0, 6.283185307), Steps=N)  # -> graft(Range)
addition = Addition(A=N, B=1)
range_2 = Range(Domain=dom, Steps=N_2)
num = Number(7.482442)
division = Division(A=range_2, B=num)
eº = PowerOfE(Value=division)
neg_2 = Negative(Value=division)
eº_2 = PowerOfE(Value=neg_2)
addition_2 = Addition(A=eº, B=eº_2)
division_2 = Division(A=addition_2, B=2)
cos = Cosine(Value=range)
sin = Sine(Value=range)
multiplication = Multiplication(A=division_2, B=num)
multiplication_2 = Multiplication(A=cos, B=multiplication)
multiplication_3 = Multiplication(A=sin, B=multiplication)
pt = ConstructPoint(XCoordinate=multiplication_2, YCoordinate=multiplication_3, ZCoordinate=range_2)  # -> flatten(Point)
srfgrid = SurfaceFromPoints(Points=pt, UCount=addition, Interpolate=False)

# ----
nv = NakedVertices(Mesh=mesh)  # -> Clothed, Naked, ClothedPts, NakedPts
springsfrommesh = SpringsFromMesh(M=mesh, stiffness=0, B=0)
nv_2 = NakedVertices(Mesh=mesh)  # -> ClothedIndex, NakedIndex, ClothedPts, NakedPts
list = ValueList({"Uniform": 0, "Cotan": 1}, selected="Cotan")
vn = VertexNeighbours(Mesh=mesh, VertexNumber=nv.Clothed)  # -> Vertex, Neighbours, Normal

timer = Timer(TimerInterval=20, Target=kangaroo)  # disabled

laplacian = Laplacian(Center=graft(vn.Vertex), Neighbours=vn.Neighbours, Strength=1000, Weighting=list)  # -> flatten(Laplacian)
kangaroo_settings = KangarooSettings(
    Tolerance=0.001,
    TimeStep=0.01,
    SubIterations=100,
    Floor=False,
    Drag=10,
    Restitution=0.7,
    StaticFriction=10,
    KineticFriction=10,
    Settle=2,
    Tumble=1,
    Sound=False,
    Solver=0)
kangaroo = KangarooPhysics(
    ForceObjects=flatten([laplacian, springsfrommesh]),
    AnchorPoints=nv_2.NakedPts,
    Settings=kangaroo_settings,
    Geometry=mesh,
    SimulationReset=Button())  # -> Out, Iterations, ParticlesOut, GeometryOut
mesh_2 = Mesh(kangaroo.GeometryOut)

# ==== cluster SpringsFromMesh: Turns all edges of a mesh into springs
M = ClusterInput()
medges = MeshEdges(Mesh=M)  # -> NakedEdges, InteriorEdges, NonManifoldEdges
crv = Curve([medges.NakedEdges, medges.InteriorEdges])
B = ClusterInput()
len = Length(Curve=crv)
multiplication = Multiplication(A=len, B=B)
stiffness = ClusterInput()
springs = SpringsFromLine(Connection=crv, Stiffness=stiffness, Damping=10, RestLength=multiplication, UpperCutoff=0, LowerCutoff=0, Plasticity=0)
S = ClusterOutput(springs)
