# Grasshopper definition marsyas1.gh (Grasshopper 0.9.75)
# plug-ins: Kangaroo Components, Weaverbird, Mesh Pipe

# based on the 'Marsyas' installation by Anish Kapoor at the Tate Modern 2002
# 
# See: http://www.arup.com/_assets/_download/download73.pdf
mesh = Mesh(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)

# ---- group: different warp/weft stiffness to control the shape
number_slider = Slider(4.345, range=0..10)
number_slider_2 = Slider(1.893, range=0..10)

# ----
wbcatmullclark = WeaverbirdsCatmullClarkSubdivision(MeshCurves=mesh, Level=3, SmoothNakedEdges=1)
warpweft = WarpWeft(Mesh=wbcatmullclark)  # -> Warp, Weft, NakedA, NakedB
cull = CullPattern(List=warpweft.Warp, CullPattern=invert(warpweft.NakedA))
cull_2 = CullPattern(List=warpweft.Weft, CullPattern=invert(warpweft.NakedB))
wbnaked = WeaverbirdsNakedBoundary(MeshClosedPolylines=wbcatmullclark)
item = ListItem(List=wbnaked, Index=0, Wrap=True)  # -> Item, Item1, Item2
springs = SpringsFromLine(Connection=cull, Stiffness=number_slider, Damping=10, RestLength=0, UpperCutoff=0, LowerCutoff=0, Plasticity=0)
springs_2 = SpringsFromLine(Connection=cull_2, Stiffness=number_slider_2, Damping=10, RestLength=0, UpperCutoff=0, LowerCutoff=0, Plasticity=0)

# ---- group: gravity on the middle ring
disc = Discontinuity(Curve=item.Item, Level=1)  # -> Points, Parameters
Z = UnitZ(Factor=expr("-x", Slider(0.661, range=0..1)))
uforce = UnaryForce(Point=disc.Points, Force=Z)

# ---- group: keep the middle ring's shape
polylinebend = PolyLineBend(polyline=item.Item, bendstrength=1000, B=0)  # -> L, B_2
springs_3 = SpringsFromLine(
    Connection=polylinebend.L,
    Stiffness=3000,
    Damping=10,
    RestLength=polylinebend.L,
    UpperCutoff=0,
    LowerCutoff=0,
    Plasticity=0)

# ---- group: fix the end rings
disc_2 = Discontinuity(Curve=[item.Item1, item.Item2], Level=1)  # -> Points, Parameters

# ----
kangaroo_settings = KangarooSettings(
    Tolerance=0.01,
    TimeStep=0.01,
    SubIterations=20,
    Floor=False,
    Drag=1,
    Restitution=0.7,
    StaticFriction=10,
    KineticFriction=10,
    Settle=2,
    Tumble=1,
    Sound=False,
    Solver=0)
entwine = Entwine(Branch00=wbnaked, Branch01=wbcatmullclark)
kangaroo = KangarooPhysics(
    ForceObjects=flatten([polylinebend.B_2, springs_3, uforce, springs, springs_2]),
    AnchorPoints=flatten(disc_2.Points),
    Settings=kangaroo_settings,
    Geometry=entwine,
    SimulationReset=True)  # -> Out, Iterations, ParticlesOut, GeometryOut
bang = ExplodeTree(Data=kangaroo.GeometryOut)  # -> Branch0, Branch1
preview = CustomPreview(
    Geometry=bang.Branch1,
    Shader={ambient=RGB(0, 0, 0), diffuse=RGB(192, 0, 0), emission=RGB(0, 0, 0), shine=0.5, specular=RGB(255, 0, 0), transparency=0})
mpipe = MeshPipe(Curve=bang.Branch0, Radius=0.1, Accuracy=0.2, Rotation=0, Segments=10, Caps=0)
preview_2 = CustomPreview(
    Geometry=mpipe,
    Shader={ambient=RGB(128, 128, 128), diffuse=RGB(0, 0, 0), emission=RGB(0, 0, 0), shine=0.5, specular=RGB(128, 128, 128), transparency=0})

# ==== cluster PolyLineBend: PolyLineBend
polyline = ClusterInput()
polyline_2 = Curve(polyline)
cls = Closed(Curve=polyline_2)  # -> Closed, Periodic
explode = Explode(Curve=polyline_2, Recursive=True)  # -> Segments, Vertices
split = SplitList(List=explode.Vertices, Index=1)  # -> ListA, ListB
shift = ShiftList(List=explode.Vertices, Shift=0, Wrap=False)
shift_2 = ShiftList(List=explode.Vertices, Shift=1, Wrap=False)
shift_3 = ShiftList(List=explode.Vertices, Shift=2, Wrap=False)
shift_4 = ShiftList(List=split.ListB, Shift=0, Wrap=True)
shift_5 = ShiftList(List=split.ListB, Shift=1, Wrap=True)
shift_6 = ShiftList(List=split.ListB, Shift=2, Wrap=True)
filter = StreamFilter(Gate=cls.Closed, Stream0=shift_3, Stream1=shift_6)
filter_2 = StreamFilter(Gate=cls.Closed, Stream0=shift_2, Stream1=shift_5)
filter_3 = StreamFilter(Gate=cls.Closed, Stream0=shift, Stream1=shift_4)
short = ShortList(ListA=filter_3, ListB=filter_2, TrimMode=2)  # -> ListA, ListB
short_2 = ShortList(ListA=filter_3, ListB=filter_2, ListC=filter, TrimMode=2)  # -> ListA, ListB, ListC
ln = Line(StartPoint=short.ListA, EndPoint=short.ListB)
L = ClusterOutput(ln)
vec2pt = Vector2Pt(PointA=short_2.ListA, PointB=short_2.ListB, Unitize=False)  # -> Vector, Length
vec2pt_2 = Vector2Pt(PointA=short_2.ListB, PointB=short_2.ListC, Unitize=False)  # -> Vector, Length
angle = Angle(VectorA=vec2pt.Vector, VectorB=vec2pt_2.Vector)  # -> Angle, Reflex
B = ClusterInput()
multiplication = Multiplication(A=angle.Angle, B=B)
bendstrength = ClusterInput()
bend = Bend(Point1=short_2.ListA, Point2=short_2.ListB, Point3=short_2.ListC, BendStrength=bendstrength, RestAngle=multiplication)
B_2 = ClusterOutput(bend)
