# Grasshopper definition Catenary1.gh (Grasshopper 0.9.75)
# plug-ins: Kangaroo Components, Weaverbird

mesh = Mesh(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)
Z = UnitZ(Factor=Slider(10, range=-50..50))
wbvertices = VerticesComponent(Mesh=mesh, Weld=True)
wbedges = MeshEdges(Mesh=mesh)
uforce = UnaryForce(Point=wbvertices, Force=Z)
springs = SpringsFromLine(
    Connection=wbedges,
    Stiffness=1000,
    Damping=10,
    RestLength=wbedges,
    Cutoff=0,
    CompressionFail=0,
    TensileFail=0,
    Plasticity=0)
pt = Point([Point(10, 10, 0), Point(10, 30, 0), Point(50, 30, 0), Point(50, 10, 0)])
kangaroo = KangarooPhysics(ForceObjects=flatten([springs, uforce]), AnchorPoints=pt, Settings=null, Geometry=mesh, SimulationReset=Toggle(True))  # -> Out, Iterations, ParticlesOut, GeometryOut
timer = Timer(TimerInterval=1, Target=kangaroo)  # disabled
mesh_2 = Mesh(kangaroo.GeometryOut)
