# Grasshopper definition Catenary2.gh (Grasshopper 0.9.14)
# plug-ins: Kangaroo Components, Weaverbird

mesh = Mesh(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)
wbnaked = WeaverBirdsNakedBoundary(MeshClosedPolylines=mesh)
explode = Explode(Curve=wbnaked, Recursive=True)  # -> Segments, Vertices
wbedges = MeshEdges(Mesh=mesh, FaceOrder=False)
slider = Slider(2000, range=0..2000)
Z = UnitZ(Factor=Slider(7, range=-50..50))
wbvertices = VerticesComponent(Mesh=mesh, Weld=True)
len = Length(Curve=wbedges)
multiplication = Multiplication(A=len, B=Slider(1.1, range=0..5))
pt = Point([Point(11.55226326, 6.497796059, 0), Point(12.78253746, 6.49780035, 0), Point(14.01280308, 6.497804642, 0), Point(15.24306107, 6.497791767, 0), Point(16.47332764, 6.497791767, 0), Point(17.70360184, 6.497796059, 0)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])
uforce = UnaryForce(Point=wbvertices, Force=Z)
curve = Curve(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)
pt_2 = Point([Point(48.4602623, 31.10312653, 0), Point(47.2299881, 31.10312271, 0), Point(45.99972916, 31.1031189, 0), Point(44.76945496, 31.10313034, 0), Point(43.53919601, 31.10313034, 0), Point(42.30892181, 31.10312653, 0)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])
curve_2 = Curve(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)
end = EndPoints(Curve=[curve_2, curve])  # -> Start, End
springs = SpringsFromLine(
    Connection=wbedges,
    Stiffness=1000,
    Damping=10,
    RestLength=multiplication,
    Cutoff=0,
    CompressionFail=0,
    TensileFail=0,
    Plasticity=0)
curvepull = CurvePull(Curve=curve, Points=pt, Strength=slider)
curvepull_2 = CurvePull(Curve=curve_2, Points=pt_2, Strength=slider)
kangaroo = KangarooPhysics(
    ForceObjects=flatten([springs, uforce, curvepull_2, curvepull]),
    AnchorPoints=[end.Start, end.End],
    Settings=null,
    Geometry=mesh,
    SimulationReset=Toggle(False))  # -> Out, Iterations, ParticlesOut, GeometryOut
timer = Timer(TimerInterval=1, Target=kangaroo)
mesh_2 = Mesh(kangaroo.GeometryOut)
