# Grasshopper definition Catenary2b.gh (Grasshopper 0.9.14)
# plug-ins: WeaverBird, Kangaroo Components

mesh = Mesh(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)
wbnaked = WeaverBirdsNakedBoundary(MeshClosedPolylines=mesh)
explode = Explode(Curve=wbnaked, Recursive=True)  # -> Segments, Vertices
wbedges = MeshEdges(Mesh=mesh, FaceOrder=False)
pt = Point(explode.Vertices)
wbvertices = VerticesComponent(Mesh=mesh, Weld=True)
Z = UnitZ(Factor=Slider(7, range=-50..50))
len = Length(Curve=wbedges)
multiplication = Multiplication(A=len, B=Slider(1.1, range=0..5))
pt_2 = Point([Point(11.55226326, 6.497796059, 0), Point(12.78253746, 6.49780035, 0), Point(14.01280308, 6.497804642, 0), Point(15.24306107, 6.497791767, 0), Point(16.47332764, 6.497791767, 0), Point(17.70360184, 6.497796059, 0)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])
pt_3 = Point([Point(11.55226326, 6.497796059, 0), Point(48.4602623, 6.497796059, 0), Point(11.55226326, 31.10312653, 0), Point(48.4602623, 31.10312653, 0)])
uforce = UnaryForce(Point=wbvertices, Force=Z)
curve = Curve(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)
pt_4 = Point([Point(48.4602623, 31.10312653, 0), Point(47.2299881, 31.10312271, 0), Point(45.99972916, 31.1031189, 0), Point(44.76945496, 31.10313034, 0), Point(43.53919601, 31.10313034, 0), Point(42.30892181, 31.10312653, 0)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])
curve_2 = Curve(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)
bang = ExplodeTree(Data=graft(pt_3))  # -> Branch0, Branch1, Branch2, Branch3
end = EndPoints(Curve=curve)  # -> Start, End
end_2 = EndPoints(Curve=curve_2)  # -> Start, End
springs = SpringsFromLine(
    Connection=wbedges,
    Stiffness=1000,
    Damping=10,
    RestLength=multiplication,
    Cutoff=0,
    CompressionFail=0,
    TensileFail=0,
    Plasticity=0)
ln = Line(StartPoint=end_2.Start, EndPoint=bang.Branch2)
ln_2 = Line(StartPoint=end_2.End, EndPoint=bang.Branch3)
ln_3 = Line(StartPoint=end.Start, EndPoint=bang.Branch0)
ln_4 = Line(StartPoint=end.End, EndPoint=bang.Branch1)
slider = Slider(2000, range=0..2000)
springs_2 = SpringsFromLine(Connection=[ln, ln_2, ln_3, ln_4], Stiffness=5000, Damping=10, RestLength=0, UpperCutoff=0, LowerCutoff=0, Plasticity=0)
pt_5 = Point([Point(10.93712521, 10.80372334, 0), Point(11.55226326, 10.18859482, 0), Point(10.93713379, 9.573470116, 0), Point(11.55227089, 8.958332062, 0), Point(10.93713379, 8.34319973, 0), Point(11.55227089, 7.728066444, 0)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])
curvepull = CurvePull(Curve=curve, Points=pt_2, Strength=slider)
curvepull_2 = CurvePull(Curve=curve_2, Points=pt_4, Strength=slider)
anchorxyz = AnchorXYZ(Point=pt_5, ConstrainX=True, ConstrainY=False, ConstrainZ=False)
kangaroo = KangarooPhysics(
    ForceObjects=flatten([springs, uforce, curvepull_2, curvepull, anchorxyz, springs_2]),
    AnchorPoints=[end_2.Start, end_2.End, end.Start, end.End],
    Settings=null,
    Geometry=mesh,
    SimulationReset=Toggle(False))  # -> Out, Iterations, ParticlesOut, GeometryOut
timer = Timer(TimerInterval=1, Target=kangaroo)
mesh_2 = Mesh(kangaroo.GeometryOut)
