# Grasshopper definition ReciprocalForce.gh (Grasshopper 0.9.75)
# plug-ins: Kangaroo Components

# ---- group: form-find compression only structure
mesh = Mesh(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)
pt = Point([Point(34.18725204, 11.75998497, 0), Point(29.71782684, 43.80343628, 0), Point(28.18881035, 29.54838371, 0), Point(20.57556915, 50.85356903, 0), Point(14.86301517, 27.05437469, 0), Point(11.60977459, 45.14772034, 0)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])
springsfrommesh = SpringsFromMesh(M=mesh, stiffness=4, B=0)
gravity = Gravity(M=mesh, F=1)
kangaroo = KangarooPhysics(ForceObjects=flatten([gravity, springsfrommesh]), AnchorPoints=pt, Settings=null, Geometry=mesh, SimulationReset=True)  # -> Out, Iterations, ParticlesOut, GeometryOut

# ----
# Once equilibrium has been reached, stop
# the first Kangaroo timer, and connect the
# mesh to the second part of the definition
mesh_2 = Mesh(kangaroo.GeometryOut)
mesh_3 = Mesh(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)  # disabled

# ---- group: Generate reciprocal force diagram
project = Project(Geometry=mesh_3, Plane=PlaneXY(0, 0, 0))  # -> Geometry, Transform; disabled
faceb = FaceBoundaries(Mesh=project.Geometry)  # disabled
explode = Explode(Curve=faceb, Recursive=True)  # -> Segments, Vertices; disabled
eval = EvaluateCurve(Curve=reparameterize(explode.Segments), Parameter=0.5)  # -> Point, Tangent, Angle; disabled
rotate = Rotate(Geometry=explode.Segments, Angle=1.570796327, Plane=eval.Point)  # -> Geometry, Transform; disabled
scale = Scale(Geometry=rotate.Geometry, Center=eval.Point, Factor=0.58)  # -> Geometry, Transform; disabled
dupln = RemoveDuplicateLines(Lines=flatten(scale.Geometry), Tolerance=0.01)  # disabled
end = EndPoints(Curve=scale.Geometry)  # -> Start, End; disabled
inter = InterconnectPoints(Pts=end.End)  # disabled
end_2 = EndPoints(Curve=dupln)  # -> Start, End; disabled
springs = SpringsFromLine(Connection=inter, Stiffness=1500, Damping=10, RestLength=0, UpperCutoff=0, LowerCutoff=0, Plasticity=0)  # disabled
translock = TranslationLock(Point1=end_2.Start, Point2=end_2.End)  # disabled
kangaroo_2 = KangarooPhysics(ForceObjects=flatten([translock, springs]), Settings=null, Geometry=dupln, SimulationReset=True)  # -> Out, Iterations, ParticlesOut, GeometryOut; disabled
crv = Curve(kangaroo_2.GeometryOut)  # disabled

# ==== cluster Gravity: Apply gravity to vertices of a mesh
M = ClusterInput()
F = ClusterInput()
mcomp = Decompose(Mesh=M)  # -> Vertices, Faces, Colours, Normals
Z = UnitZ(Factor=F)
duppt = RemoveDuplicatePts(Points=mcomp.Vertices, Tolerance=0.01)
uforce = UnaryForce(Point=duppt, Force=Z)
U = ClusterOutput(uforce)

# ==== cluster SpringsFromMesh: Turns all edges of a mesh into springs
M = ClusterInput()
medges = MeshEdges(Mesh=M)  # -> NakedEdges, InteriorEdges, NonManifoldEdges
crv = Curve([medges.NakedEdges, medges.InteriorEdges])
B = ClusterInput()
len = Length(Curve=crv)
multiplication = Multiplication(A=len, B=B)
stiffness = ClusterInput()
springs = SpringsFromLine(Connection=crv, Stiffness=stiffness, Damping=10, RestLength=multiplication, UpperCutoff=0, LowerCutoff=0, Plasticity=0)
S = ClusterOutput(springs)
