# Grasshopper definition bending2.gh (Grasshopper 0.9.61)
# plug-ins: Kangaroo Components

angle = Slider(0.5, range=0..1)
# A rest angle can be supplied in radians
crv = Curve(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)
pt = Point(Point(10, 20, 0))
pt_2 = Point(Point(20, 24, 0))
pt_3 = Point(Point(30, 20, 0))
explode = Explode(Curve=crv, Recursive=True)  # -> Segments, Vertices
pi = Pi(Factor=angle)
bend = Bend(Point1=pt, Point2=pt_2, Point3=pt_3, BendStrength=100, RestAngle=pi)
springs = SpringsFromLine(
    Connection=explode.Segments,
    Stiffness=1000,
    Damping=10,
    RestLength=explode.Segments,
    UpperCutoff=0,
    LowerCutoff=0,
    Plasticity=0)

timer = Timer(TimerInterval=20, Target=kangaroo)  # disabled

# ----
# Note the flattening of Force objects input
kangaroo = KangarooPhysics(ForceObjects=flatten([bend, springs]), Settings=null, Geometry=crv, SimulationReset=Toggle(True))  # -> Out, Iterations, ParticlesOut, GeometryOut
crv_2 = Curve(kangaroo.GeometryOut)
