# Grasshopper definition bending3.gh (Grasshopper 0.9.61)
# plug-ins: Kangaroo Components

pt = Point(Point(10.71811096, 14.95025244, 0))
pt_2 = Point(Point(13.32154617, 24.64081683, 0))
pt_3 = Point(Point(23.01211056, 27.82279319, 0))
pt_4 = Point(Point(32.55803965, 22.47128749, 0))
crv = Curve(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)
explode = Explode(Curve=crv, Recursive=True)  # -> Segments, Vertices
# We can achieve the same thing as the
# previous definition in a more compact
# way by using a single bending force
# component.
bend = Bend(Point1=[pt, pt_2], Point2=[pt_2, pt_3], Point3=[pt_3, pt_4], BendStrength=100, RestAngle=0)
springs = SpringsFromLine(
    Connection=explode.Segments,
    Stiffness=1000,
    Damping=10,
    RestLength=explode.Segments,
    UpperCutoff=0,
    LowerCutoff=0,
    Plasticity=0)

timer = Timer(TimerInterval=20, Target=kangaroo)  # disabled

# ----
# Note the flattening of Force objects input
kangaroo = KangarooPhysics(ForceObjects=flatten([bend, springs]), Settings=null, Geometry=crv, SimulationReset=Toggle(True))  # -> Out, Iterations, ParticlesOut, GeometryOut
crv_2 = Curve(kangaroo.GeometryOut)
