# Grasshopper definition bending4.gh (Grasshopper 0.9.61)
# plug-ins: Kangaroo Components

# If we want to apply bending resistance to
# a curve, we must divide into many
# segments, then create a Bend force for
# every consecutive set of 3 points.
crv = Curve(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)
# We use "Shift List" with "Wrap" set to
# False, because the curve is open,
# and we do not want to apply bending
# between the start and end segments.
panel = Panel("50")
divide = DivideCurve(Curve=crv, Count=panel, Kinks=False)  # -> Points, Tangents, Parameters
shift = ShiftList(List=divide.Points, Shift="0", Wrap="false")
shift_2 = ShiftList(List=divide.Points, Shift="1", Wrap="false")
shift_3 = ShiftList(List=divide.Points, Shift="2", Wrap="false")
short = ShortestList(ListA=shift, ListB=shift_2, TrimMode=2)  # -> ListA, ListB
# The lists must be trimmed
# to the same length.
short_2 = ShortestList(ListA=shift, ListB=shift_2, ListC=shift_3, TrimMode=2)  # -> ListA, ListB, ListC
ln = Line(StartPoint=short.ListA, EndPoint=short.ListB)
bend = Bend(Point1=short_2.ListA, Point2=short_2.ListB, Point3=short_2.ListC, BendStrength=100, RestAngle=0)

timer = Timer(TimerInterval=20, Target=kangaroo)  # disabled

springs = SpringsFromLine(Connection=ln, Stiffness=1000, Damping=10, RestLength=ln, UpperCutoff=0, LowerCutoff=0, Plasticity=0)
kangaroo = KangarooPhysics(ForceObjects=flatten([springs, bend]), Settings=null, Geometry=ln, SimulationReset=Toggle(True))  # -> Out, Iterations, ParticlesOut, GeometryOut
crv_2 = Curve(kangaroo.GeometryOut)
