# Grasshopper definition bending5.gh (Grasshopper 0.9.61)
# plug-ins: Kangaroo Components

# If we want to apply bending resistance to
# a curve, we must divide into many
# segments, then create a Bend force for
# every consecutive set of 3 points.
crv = Curve(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)
divide = DivideCurve(Curve=crv, Count="50", Kinks=False)  # -> Points, Tangents, Parameters
# Here we set "Wrap" to True,
# because the curve is closed.
panel = Panel("true")
shift = ShiftList(List=divide.Points, Shift="0", Wrap=panel)
shift_2 = ShiftList(List=divide.Points, Shift="1", Wrap=panel)
# The lists are already the
# same length, so do not
# need to be trimmed.
shift_3 = ShiftList(List=divide.Points, Shift="2", Wrap=panel)
ln = Line(StartPoint=shift, EndPoint=shift_2)
bend = Bend(Point1=shift, Point2=shift_2, Point3=shift_3, BendStrength=100, RestAngle=0)

timer = Timer(TimerInterval=20, Target=kangaroo)  # disabled

springs = SpringsFromLine(Connection=ln, Stiffness=1000, Damping=10, RestLength=ln, UpperCutoff=0, LowerCutoff=0, Plasticity=0)
kangaroo = KangarooPhysics(ForceObjects=flatten([springs, bend]), Settings=null, Geometry=ln, SimulationReset=Toggle(True))  # -> Out, Iterations, ParticlesOut, GeometryOut
crv_2 = Curve(kangaroo.GeometryOut)
