# Grasshopper definition bending6.gh (Grasshopper 0.9.61)
# plug-ins: Kangaroo Components

crv = Curve(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)
crv_2 = Curve(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)
divide = DivideCurve(Curve=crv, Count="50", Kinks=False)  # -> Points, Tangents, Parameters
divide_2 = DivideCurve(Curve=crv_2, Count="50", Kinks=False)  # -> Points, Tangents, Parameters
# Curves still have to be divided into points
# and converted to Polylines (setting the
# "Closed" option to True or False
# appropriately).
# 
# Kangaroo does not work directly with
# NURBS curves.
panel = Panel("true")
pline = PolyLine(Vertices=divide.Points, Closed=panel)
pline_2 = PolyLine(Vertices=divide_2.Points, Closed="false")

# ----
# The PolyLineBend UserObject (found in
# the Kangaroo Utilities tab) can simplify
# things further. If you edit the cluster, you
# will see that inside it is essentially the
# same as the previous definitions.
polylinebend = PolyLineBend(polyline=pline_2, bendstrength=100, B=0)  # -> L, B_2
polylinebend_2 = PolyLineBend(polyline=pline, bendstrength=100, B=0)  # -> L, B_2

crv_3 = Curve([polylinebend.L, polylinebend_2.L])
springs = SpringsFromLine(Connection=crv_3, Stiffness=1000, Damping=10, RestLength=crv_3, UpperCutoff=0, LowerCutoff=0, Plasticity=0)

timer = Timer(TimerInterval=20, Target=kangaroo)  # disabled

# ----
# Don't forget to flatten the force input!
kangaroo = KangarooPhysics(
    ForceObjects=flatten([springs, polylinebend.B_2, polylinebend_2.B_2]),
    Settings=null,
    Geometry=[pline_2, pline],
    SimulationReset=Toggle(True))  # -> Out, Iterations, ParticlesOut, GeometryOut

# ==== cluster PolyLineBend: PolyLineBend
polyline = ClusterInput()
polyline_2 = Curve(polyline)
cls = Closed(Curve=polyline_2)  # -> Closed, Periodic
explode = Explode(Curve=polyline_2, Recursive=True)  # -> Segments, Vertices
split = SplitList(List=explode.Vertices, Index=1)  # -> ListA, ListB
shift = ShiftList(List=explode.Vertices, Shift=0, Wrap=False)
shift_2 = ShiftList(List=explode.Vertices, Shift=1, Wrap=False)
shift_3 = ShiftList(List=explode.Vertices, Shift=2, Wrap=False)
shift_4 = ShiftList(List=split.ListB, Shift=0, Wrap=True)
shift_5 = ShiftList(List=split.ListB, Shift=1, Wrap=True)
shift_6 = ShiftList(List=split.ListB, Shift=2, Wrap=True)
filter = StreamFilter(Gate=cls.Closed, Stream0=shift_3, Stream1=shift_6)
filter_2 = StreamFilter(Gate=cls.Closed, Stream0=shift_2, Stream1=shift_5)
filter_3 = StreamFilter(Gate=cls.Closed, Stream0=shift, Stream1=shift_4)
short = ShortList(ListA=filter_3, ListB=filter_2, TrimMode=2)  # -> ListA, ListB
short_2 = ShortList(ListA=filter_3, ListB=filter_2, ListC=filter, TrimMode=2)  # -> ListA, ListB, ListC
ln = Line(StartPoint=short.ListA, EndPoint=short.ListB)
L = ClusterOutput(ln)
vec2pt = Vector2Pt(PointA=short_2.ListA, PointB=short_2.ListB, Unitize=False)  # -> Vector, Length
vec2pt_2 = Vector2Pt(PointA=short_2.ListB, PointB=short_2.ListC, Unitize=False)  # -> Vector, Length
angle = Angle(VectorA=vec2pt.Vector, VectorB=vec2pt_2.Vector)  # -> Angle, Reflex
B = ClusterInput()
multiplication = Multiplication(A=angle.Angle, B=B)
bendstrength = ClusterInput()
bend = Bend(Point1=short_2.ListA, Point2=short_2.ListB, Point3=short_2.ListC, BendStrength=bendstrength, RestAngle=multiplication)
B_2 = ClusterOutput(bend)
