# Grasshopper definition bending7.gh (Grasshopper 0.9.61)
# plug-ins: Kangaroo Components

crv = Curve(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)
divide = DivideCurve(Curve=crv, Count=50, Kinks=False)  # -> Points, Tangents, Parameters
# Fixing only one point at the end leaves
# the direction free to change.
panel = Panel("0")
# By anchoring the first 2 points of the
# polyline we can control both its position
# and  tangent direction.
item = ListItem(List=divide.Points, Index="0", Wrap=True)  # -> Item, Item1
pline = PolyLine(Vertices=divide.Points, Closed=False)
position = Slider(0, range=0..1)
direction = ControlKnob(Decimals=2, Limit=True, Maximum=28.27, Minimum=0, Range=6.28, Value=0)
item_2 = ListItem(List=reverse(divide.Points), Index=panel, Wrap=True)
polylinebend = PolyLineBend(polyline=pline, bendstrength=1000, B=0)  # -> L, B_2
# We can get the last point in the
# list by reversing it and taking
# item 0
vec = Vector(Vector(33, 16, 0))
multiplication = Multiplication(A=position, B=vec)
rotate = Rotate(Geometry=item.Item1, Angle=direction, Plane=item.Item)  # -> Geometry, Transform
springs = SpringsFromLine(
    Connection=polylinebend.L,
    Stiffness=3000,
    Damping=10,
    RestLength=polylinebend.L,
    UpperCutoff=0,
    LowerCutoff=0,
    Plasticity=0)
move = Move(Geometry=[item.Item, rotate.Geometry], Motion=multiplication)  # -> Geometry, Transform
# Alternatively we could use points
# referenced  directly from Rhino here
pt = Point([move.Geometry, item_2])
# If we reset the simulation, we need to
# move the AnchorPoints back to their
# original location to reattach them before
# playing again.
timer = Timer(TimerInterval=20, Target=kangaroo)  # disabled
kangaroo = KangarooPhysics(
    ForceObjects=flatten([polylinebend.B_2, springs]),
    AnchorPoints=pt,
    Settings=null,
    Geometry=pline,
    SimulationReset=Toggle(True))  # -> Out, Iterations, ParticlesOut, GeometryOut
crv_2 = Curve(kangaroo.GeometryOut)

# ==== cluster PolyLineBend: PolyLineBend
polyline = ClusterInput()
polyline_2 = Curve(polyline)
cls = Closed(Curve=polyline_2)  # -> Closed, Periodic
explode = Explode(Curve=polyline_2, Recursive=True)  # -> Segments, Vertices
split = SplitList(List=explode.Vertices, Index=1)  # -> ListA, ListB
shift = ShiftList(List=explode.Vertices, Shift=0, Wrap=False)
shift_2 = ShiftList(List=explode.Vertices, Shift=1, Wrap=False)
shift_3 = ShiftList(List=explode.Vertices, Shift=2, Wrap=False)
shift_4 = ShiftList(List=split.ListB, Shift=0, Wrap=True)
shift_5 = ShiftList(List=split.ListB, Shift=1, Wrap=True)
shift_6 = ShiftList(List=split.ListB, Shift=2, Wrap=True)
filter = StreamFilter(Gate=cls.Closed, Stream0=shift_3, Stream1=shift_6)
filter_2 = StreamFilter(Gate=cls.Closed, Stream0=shift_2, Stream1=shift_5)
filter_3 = StreamFilter(Gate=cls.Closed, Stream0=shift, Stream1=shift_4)
short = ShortList(ListA=filter_3, ListB=filter_2, TrimMode=2)  # -> ListA, ListB
short_2 = ShortList(ListA=filter_3, ListB=filter_2, ListC=filter, TrimMode=2)  # -> ListA, ListB, ListC
ln = Line(StartPoint=short.ListA, EndPoint=short.ListB)
L = ClusterOutput(ln)
vec2pt = Vector2Pt(PointA=short_2.ListA, PointB=short_2.ListB, Unitize=False)  # -> Vector, Length
vec2pt_2 = Vector2Pt(PointA=short_2.ListB, PointB=short_2.ListC, Unitize=False)  # -> Vector, Length
angle = Angle(VectorA=vec2pt.Vector, VectorB=vec2pt_2.Vector)  # -> Angle, Reflex
B = ClusterInput()
multiplication = Multiplication(A=angle.Angle, B=B)
bendstrength = ClusterInput()
bend = Bend(Point1=short_2.ListA, Point2=short_2.ListB, Point3=short_2.ListC, BendStrength=bendstrength, RestAngle=multiplication)
B_2 = ClusterOutput(bend)
