# Grasshopper definition gridshell.gh (Grasshopper 0.9.75)
# plug-ins: Kangaroo Components

# We need to 'nudge' the geometry to get it
# to buckle out of plane. Push this button once
# after starting the simulation to nudge
button = Button()
crv = Curve([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])
divlength = DivideLength(Curve=crv, Length=1)  # -> Points, Tangents, Parameters
# Start the simulation with this slider set at 1
# Then after starting the simulation (by setting
# SimulationReset to False and turning on the
# timer) you can gradually reduce it to push the
# gridshell up into shape.
slider = Slider(1, range=0..1)
duppt = RemoveDuplicatePts(Points=flatten(divlength.Points), Tolerance=0.01)
Z = UnitZ(Factor=button)
pline = PolyLine(Vertices=divlength.Points, Closed=False)
pt = Point([Point(10, 30, 0), Point(10, 10, 0), Point(40, 10, 0), Point(40, 30, 0)])
uforce = UnaryForce(Point=duppt, Force=Z)
polylinebend = PolyLineBend(polyline=pline, bendstrength=500, B=0)  # -> L, B_2
scale = Scale(Geometry=pt, Center=Point(25, 20, 0), Factor=slider)  # -> Geometry, Transform

timer = Timer(TimerInterval=20, Target=kangaroo)  # disabled

springs = SpringsFromLine(
    Connection=polylinebend.L,
    Stiffness=4000,
    Damping=10,
    RestLength=polylinebend.L,
    UpperCutoff=0,
    LowerCutoff=0,
    Plasticity=0)
kangaroo = KangarooPhysics(
    ForceObjects=flatten([springs, uforce, polylinebend.B_2]),
    AnchorPoints=scale.Geometry,
    Settings=null,
    Geometry=pline,
    SimulationReset=Toggle(True))  # -> Out, Iterations, ParticlesOut, GeometryOut
crv_2 = Curve(kangaroo.GeometryOut)

# ==== cluster PolyLineBend: PolyLineBend
polyline = ClusterInput()
polyline_2 = Curve(polyline)
cls = Closed(Curve=polyline_2)  # -> Closed, Periodic
explode = Explode(Curve=polyline_2, Recursive=True)  # -> Segments, Vertices
split = SplitList(List=explode.Vertices, Index=1)  # -> ListA, ListB
shift = ShiftList(List=explode.Vertices, Shift=0, Wrap=False)
shift_2 = ShiftList(List=explode.Vertices, Shift=1, Wrap=False)
shift_3 = ShiftList(List=explode.Vertices, Shift=2, Wrap=False)
shift_4 = ShiftList(List=split.ListB, Shift=0, Wrap=True)
shift_5 = ShiftList(List=split.ListB, Shift=1, Wrap=True)
shift_6 = ShiftList(List=split.ListB, Shift=2, Wrap=True)
filter = StreamFilter(Gate=cls.Closed, Stream0=shift_3, Stream1=shift_6)
filter_2 = StreamFilter(Gate=cls.Closed, Stream0=shift_2, Stream1=shift_5)
filter_3 = StreamFilter(Gate=cls.Closed, Stream0=shift, Stream1=shift_4)
short = ShortList(ListA=filter_3, ListB=filter_2, TrimMode=2)  # -> ListA, ListB
short_2 = ShortList(ListA=filter_3, ListB=filter_2, ListC=filter, TrimMode=2)  # -> ListA, ListB, ListC
ln = Line(StartPoint=short.ListA, EndPoint=short.ListB)
L = ClusterOutput(ln)
vec2pt = Vector2Pt(PointA=short_2.ListA, PointB=short_2.ListB, Unitize=False)  # -> Vector, Length
vec2pt_2 = Vector2Pt(PointA=short_2.ListB, PointB=short_2.ListC, Unitize=False)  # -> Vector, Length
angle = Angle(VectorA=vec2pt.Vector, VectorB=vec2pt_2.Vector)  # -> Angle, Reflex
B = ClusterInput()
multiplication = Multiplication(A=angle.Angle, B=B)
bendstrength = ClusterInput()
bend = Bend(Point1=short_2.ListA, Point2=short_2.ListB, Point3=short_2.ListC, BendStrength=bendstrength, RestAngle=multiplication)
B_2 = ClusterOutput(bend)
