# Grasshopper definition bending2.gh (Grasshopper 0.9.14)
# plug-ins: Kangaroo Components

crv = Curve([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])
# Start the simulation with this slider set at 1
# Then after starting the simulation (by setting
# SimulationReset to False and turning on the
# timer) you can gradually reduce it to push the
# gridshell up into shape.
slider = Slider(1, range=0..1)
divlength = DivideLength(Curve=crv, Length=1)  # -> Points, Tangents, Parameters
duppt = RemoveDuplicatePts(Points=flatten(divlength.Points), Tolerance=0.01)
Z = UnitZ(Factor=Slider(0.1, range=0.1..10))
pt = Point([Point(10, 30, 0), Point(10, 10, 0), Point(40, 10, 0), Point(40, 30, 0)])
bendcurve = Bendcurve(
    Points=divlength.Points,
    Points_2=divlength.Points,
    List=bendcurve.Point,
    Shift=1,
    Wrap=False,
    List_2=bendcurve.Point,
    Shift_2=2,
    Wrap_2=False,
    List_3=bendcurve.Point,
    Shift_3=0,
    Wrap_3=False,
    List_4=bendcurve.List,
    List_5=bendcurve.List,
    Index=bendcurve.Length,
    List_6=bendcurve.List,
    Index_2=bendcurve.Length,
    Point=bendcurve.ListA,
    Point_2=bendcurve.ListA,
    Point_3=bendcurve.List,
    PointA=bendcurve.ListA,
    PointB=bendcurve.ListA,
    Unitize=False,
    PointA_2=bendcurve.ListA,
    PointB_2=bendcurve.List,
    Unitize_2=False,
    VectorA=bendcurve.Vector,
    VectorB=bendcurve.Vector,
    StartPoint=bendcurve.List,
    EndPoint=bendcurve.List,
    Number=bendcurve.Angle,
    Point_4=bendcurve.Point,
    Line=bendcurve.Line,
    Point_5=bendcurve.Point,
    Point_6=bendcurve.Point,
    Point_7=bendcurve.Point,
    Number_2=bendcurve.Number,
    InternalDocument_plugin_version=(0, 9, 14),
    InternalDocument_DocumentHeader_PreviewNormal=RGBA(150, 0, 0, 100),
    InternalDocument_DocumentHeader_PreviewSelected=RGBA(0, 150, 0, 100),
    InternalDocument_DocumentHeader_PreviewMeshType=1,
    InternalDocument_DefinitionProperties_Projection_Zoom=0.8000000119,
    InternalDocument_DefinitionObjects_Object12_Container_DataComparison="shortest_list")  # -> Segments, Point1, Point2, Point3, Number, Segments_2, Point1_2, Point2_2, Point3_2, Number_2
uforce = UnaryForce(Point=duppt, Force=Z)
scale = Scale(Geometry=pt, Center=Point(25, 20, 0), Factor=slider)  # -> Geometry, Transform
bend = Bend(Point1=bendcurve.Point1_2, Point2=bendcurve.Point2_2, Point3=bendcurve.Point3_2, BendStrength=500, RestAngle=0)
springs = SpringsFromLine(
    Connection=bendcurve.Segments_2,
    Stiffness=4000,
    Damping=10,
    RestLength=bendcurve.Segments_2,
    UpperCutoff=0,
    LowerCutoff=0,
    Plasticity=0)
timer = Timer(TimerInterval=20, Target=kangaroo)  # disabled
kangaroo = KangarooPhysics(
    ForceObjects=flatten([springs, bend, uforce]),
    AnchorPoints=scale.Geometry,
    Settings=null,
    Geometry=bendcurve.Segments_2,
    SimulationReset=Toggle(False))  # -> Out, Iterations, ParticlesOut, GeometryOut
crv_2 = Curve(kangaroo.GeometryOut)
