# Grasshopper definition drape1.gh (Grasshopper 0.9.75)
# plug-ins: Kangaroo Components, Weaverbird

mesh = Mesh(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)
srf = Surface(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)
wbedges = WeaverBirdsMeshEdges(MeshOrPolylines=mesh)
extr = Extrude(Base=srf, Direction=Vector(0, 0, -19))
wbvertices = WeaverBirdsVerticesComponent(MeshClosedPolylinesGroup=mesh, Weld=True)
springs = SpringsFromLine(Connection=wbedges, Stiffness=2000, Damping=10, RestLength=wbedges, UpperCutoff=0, LowerCutoff=0, Plasticity=0)
uforce = UnaryForce(Point=wbvertices, Force=Vector(0, 0, -1))
mesh_2 = MeshBrep(
    Brep=extr,
    Settings={GridMaxCount=0, GridMinCount=16, JaggedSeams=False, MaxEdgeLength=0, MinEdgeLength=0.0001, MinTolerance=0, Refine=True, RefineAngle=0, RelativeTolerance=0.65, SimplePlanes=True, Tolerance=0})
collidemesh = CollideMesh(Solid=mesh_2, Points=wbvertices, Hardness=0.7, Traction=0.5)
timer = Timer(TimerInterval=20, Target=kangaroo)  # disabled
kangaroo = KangarooPhysics(ForceObjects=flatten([uforce, springs, collidemesh]), Settings=null, Geometry=mesh, SimulationReset=Toggle(False))  # -> Out, Iterations, ParticlesOut, GeometryOut
wbedges_2 = WeaverBirdsMeshEdges(MeshOrPolylines=kangaroo.GeometryOut)
len = Length(Curve=wbedges_2)
bnd = Bounds(Numbers=len)
num = Number(bnd)
panel = Panel(num)
