# Grasshopper definition sphere_drape.gh (Grasshopper 0.9.14)
# plug-ins: WeaverBird, Kangaroo Components

slider = Slider(3.536, range=0..10)
pt = Point([Point(12.49108705, 10.32890745, 3.115149305), Point(8.119302242, 6.629704918, 3.115149305), Point(7.312203509, 11.94310491, 3.115149305)])
mesh = Mesh(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)
wbedges = WeaverBirdsMeshEdges(MeshOrPolylines=mesh, FaceOrder=False)
Z = UnitZ(Factor=-10)
wbvertices = WeaverBirdsVerticesComponent(MeshClosedPolylinesGroup=mesh, Weld=True)
springs = SpringsFromLine(Connection=wbedges, Stiffness=5000, Damping=10, RestLength=wbedges, UpperCutoff=0, LowerCutoff=0, Plasticity=0)
uforce = UnaryForce(Point=wbvertices, Force=Z)
ln = Line(StartPoint=graft(pt), EndPoint=wbvertices)
anchorxyz = AnchorXYZ(Point=pt, ConstrainX=True, ConstrainY=True, ConstrainZ=True)
sph = Sphere(Base=pt, Radius=slider)
springs_2 = SpringsFromLine(Connection=ln, Stiffness=5000, Damping=10, RestLength=slider, UpperCutoff=slider, LowerCutoff=0, Plasticity=0)
kangaroo_settings = KangarooSettings(
    Tolerance=0.001,
    TimeStep=0.01,
    SubIterations=10,
    Floor=True,
    Drag=10,
    Restitution=0.7,
    StaticFriction=10,
    KineticFriction=10,
    Settle=2,
    Tumble=1,
    Sound=False,
    Solver=0)
kangaroo = KangarooPhysics(
    ForceObjects=flatten([springs, anchorxyz, uforce, springs_2]),
    Settings=kangaroo_settings,
    Geometry=wbedges,
    SimulationReset=Toggle(True))  # -> Out, Iterations, ParticlesOut, GeometryOut
timer = Timer(TimerInterval=20, Target=kangaroo)  # disabled
crv = Curve(kangaroo.GeometryOut)
