# Grasshopper definition Origami2.gh (Grasshopper 0.9.61)
# plug-ins: Kangaroo Components

folding = Slider(0.648, range=0..1)

# ---- group: mesh of flat folding pattern
mesh = Mesh(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)

# ----
timer = Timer(TimerInterval=20, Target=kangaroo)  # disabled

# ---- group: Valley fold lines
crv = Curve([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])

# ---- group: Mountain fold lines
crv_2 = Curve([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])

# ----
hingepoints = HingePoints(Mesh=mesh)  # -> _1, _2, _3, _4
strength = Panel("0.01")
strength_2 = Panel("1")
angle = Panel("pi")
angle_2 = Panel("-pi/2")
springsfrommesh = SpringsFromMesh(M=mesh, stiffness=100, B=1)
planarizequads = PlanarizeQuads(M=mesh, planarizestrength=1000)
eval = EvaluateCurve(Curve=reparameterize(crv), Parameter=0.5)  # -> Point, Tangent, Angle
ln = Line(StartPoint=hingepoints._1, EndPoint=hingepoints._2)
eval_2 = EvaluateCurve(Curve=reparameterize(crv_2), Parameter=0.5)  # -> Point, Tangent, Angle
multiplication = Multiplication(A=angle_2, B=folding)
multiplication_2 = Multiplication(A=angle, B=folding)
eval_3 = EvaluateCurve(Curve=reparameterize(ln), Parameter=0.5)  # -> graft(Point), Tangent, Angle
cp = ClosestPoint(Point=eval_3.Point, Cloud=eval_2.Point)  # -> ClosestPoint, CPIndex, Distance
cp_2 = ClosestPoint(Point=eval_3.Point, Cloud=eval.Point)  # -> ClosestPoint, CPIndex, Distance
larger = LargerThan(FirstNumber=0.01, SecondNumber=cp.Distance)  # -> LargerThan, OrEqualTo
larger_2 = LargerThan(FirstNumber=0.01, SecondNumber=cp_2.Distance)  # -> LargerThan, OrEqualTo
cull = CullPattern(List=strength, CullPattern=larger_2.LargerThan)
cull_2 = CullPattern(List=multiplication, CullPattern=larger_2.LargerThan)
cull_3 = CullPattern(List=strength_2, CullPattern=larger.LargerThan)
cull_4 = CullPattern(List=multiplication_2, CullPattern=larger.LargerThan)
addition = Addition(A=cull, B=cull_3)
addition_2 = Addition(A=cull_2, B=cull_4)
addition_3 = Addition(A=0, B=addition)  # -> flatten(Result)
addition_4 = Addition(A=0, B=addition_2)  # -> flatten(Result)
hinge = Hinge(
    Point1=hingepoints._1,
    Point2=hingepoints._2,
    Point3=hingepoints._3,
    Point4=hingepoints._4,
    Strength=addition_3,
    RestAngle=addition_4)
unweld = UnweldMesh(Mesh=mesh, Angle=0)
kangaroo = KangarooPhysics(ForceObjects=flatten([springsfrommesh, planarizequads, hinge]), Settings=null, Geometry=unweld, SimulationReset=Button())  # -> Out, Iterations, ParticlesOut, GeometryOut
unweld_2 = UnweldMesh(Mesh=kangaroo.GeometryOut, Angle=0)
medges = MeshEdges(Mesh=unweld_2)  # -> NakedEdges, InteriorEdges, NonManifoldEdges
preview = CustomPreview(
    Geometry=unweld_2,
    Shader={ambient=RGB(128, 128, 128), diffuse=RGB(192, 192, 192), emission=RGB(0, 0, 0), shine=0.5, specular=RGB(255, 255, 255), transparency=0})

# ==== cluster SpringsFromMesh: Turns all edges of a mesh into springs
M = ClusterInput()
medges = MeshEdges(Mesh=M)  # -> NakedEdges, InteriorEdges, NonManifoldEdges
crv = Curve([medges.NakedEdges, medges.InteriorEdges])
B = ClusterInput()
len = Length(Curve=crv)
multiplication = Multiplication(A=len, B=B)
stiffness = ClusterInput()
springs = SpringsFromLine(Connection=crv, Stiffness=stiffness, Damping=10, RestLength=multiplication, UpperCutoff=0, LowerCutoff=0, Plasticity=0)
S = ClusterOutput(springs)

# ==== cluster PlanarizeQuads: Applies a planarization force to any quads in a mesh
M = ClusterInput()
mcomp = Decompose(Mesh=M)  # -> Vertices, Faces, Colours, Normals
vertices = FaceVertices(Face=mcomp.Faces)  # -> CornerA, CornerB, CornerC, CornerD
planarizestrength = ClusterInput()
item = ListItem(List=mcomp.Vertices, Index=vertices.CornerA, Wrap=False)
item_2 = ListItem(List=mcomp.Vertices, Index=vertices.CornerB, Wrap=False)
item_3 = ListItem(List=mcomp.Vertices, Index=vertices.CornerC, Wrap=False)
item_4 = ListItem(List=mcomp.Vertices, Index=vertices.CornerD, Wrap=False)
planarize = Planarize(Point1=item, Point2=item_2, Point3=item_3, Point4=item_4, PlanarizeStrength=planarizestrength)
equals = Equality(FirstNumber=vertices.CornerC, SecondNumber=vertices.CornerD)  # -> Equality, Inequality
cull = CullPattern(List=planarize, CullPattern=equals.Inequality)
L = ClusterOutput(cull)
