# Grasshopper definition hinge1.gh (Grasshopper 0.9.61)
# plug-ins: Kangaroo Components

mesh = Mesh(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)
point1 = Point1(Point(26, 12, 0))
point2 = Point2(Point(23, 33, 0))
point3 = Point3(Point(12, 20, 0))
point4 = Point4(Point(29.26947558, 24.18135365, 9.535468137))
pi = Pi(Factor=Slider(0, range=-1..1))
# Note the order of points input
pt = Point([point1, point2, point3, point4])
hinge = Hinge(Point1=point1, Point2=point2, Point3=point3, Point4=point4, Strength=500, RestAngle=pi)
springsfrommesh = SpringsFromMesh(M=mesh, stiffness=1000, B=1)
points = PointList(Points=pt, Tags=True, Lines=False, Size=2)

timer = Timer(TimerInterval=20, Target=kangaroo)  # disabled

kangaroo = KangarooPhysics(ForceObjects=flatten([springsfrommesh, hinge]), Settings=null, Geometry=mesh, SimulationReset=Toggle(False))  # -> Out, Iterations, ParticlesOut, GeometryOut

# ==== cluster SpringsFromMesh: Turns all edges of a mesh into springs
M = ClusterInput()
medges = MeshEdges(Mesh=M)  # -> NakedEdges, InteriorEdges, NonManifoldEdges
crv = Curve([medges.NakedEdges, medges.InteriorEdges])
B = ClusterInput()
len = Length(Curve=crv)
multiplication = Multiplication(A=len, B=B)
stiffness = ClusterInput()
springs = SpringsFromLine(Connection=crv, Stiffness=stiffness, Damping=10, RestLength=multiplication, UpperCutoff=0, LowerCutoff=0, Plasticity=0)
S = ClusterOutput(springs)
