# Grasshopper definition hinge2.gh (Grasshopper 0.9.61)
# plug-ins: Kangaroo Components

mesh = Mesh(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)

pi = Pi(Factor=Slider(0, range=-1..1))
hingepoints = HingePoints(Mesh=mesh)  # -> _1, _2, _3, _4
hinge = Hinge(Point1=hingepoints._1, Point2=hingepoints._2, Point3=hingepoints._3, Point4=hingepoints._4, Strength=500, RestAngle=pi)

# ----
# Alternatively
shell = Shell(M=mesh, strength=1000, B=Slider(0, range=-1..1))

# ----
# Remember - we nearly always need some springs
# in addition to any other forces
springsfrommesh = SpringsFromMesh(M=mesh, stiffness=1000, B=1)

timer = Timer(TimerInterval=20, Target=kangaroo)

kangaroo = KangarooPhysics(ForceObjects=flatten([springsfrommesh, hinge]), Settings=null, Geometry=mesh, SimulationReset=Toggle(False))  # -> Out, Iterations, ParticlesOut, GeometryOut

# ==== cluster SpringsFromMesh: Turns all edges of a mesh into springs
M = ClusterInput()
medges = MeshEdges(Mesh=M)  # -> NakedEdges, InteriorEdges, NonManifoldEdges
crv = Curve([medges.NakedEdges, medges.InteriorEdges])
B = ClusterInput()
len = Length(Curve=crv)
multiplication = Multiplication(A=len, B=B)
stiffness = ClusterInput()
springs = SpringsFromLine(Connection=crv, Stiffness=stiffness, Damping=10, RestLength=multiplication, UpperCutoff=0, LowerCutoff=0, Plasticity=0)
S = ClusterOutput(springs)

# ==== cluster Shell: Give a mesh bending stiffness. AngleFactor sets the rest state - 0 is flat, 1 keeps the original angles
M = ClusterInput()
hingepoints = HingePoints(Mesh=M)  # -> _1, _2, _3, _4
fa = FoldAngle(Point1=hingepoints._1, Point2=hingepoints._2, Point3=hingepoints._3, Point4=hingepoints._4)
B = ClusterInput()
multiplication = Multiplication(A=fa, B=B)
strength = ClusterInput()
hinge = Hinge(
    Point1=hingepoints._1,
    Point2=hingepoints._2,
    Point3=hingepoints._3,
    Point4=hingepoints._4,
    Strength=strength,
    RestAngle=multiplication)
H = ClusterOutput(hinge)
