# Grasshopper definition MeshInflate_collide.gh (Grasshopper 0.9.61)
# plug-ins: Kangaroo Components, Weaverbird

mplane = MeshPlane(Boundary={Plane=PlaneXY(0, 0, 0), Size=Domain2(u=-10..10, v=-10..10)}, WidthCount=10, HeightCount=10)  # -> Mesh, Area
nv = NakedVertices(Mesh=mplane.Mesh)  # -> ClothedIndex, NakedIndex, ClothedPts, NakedPts
mcomp = Decompose(Mesh=mplane.Mesh)  # -> Vertices, Faces, Colours, Normals
Z = UnitZ(Factor=Slider(0.25, range=0..1))
move = Move(Geometry=nv.ClothedPts, Motion=Z)  # -> Geometry, Transform
replace = ListReplace(List=mcomp.Vertices, Item=move.Geometry, Indices=nv.ClothedIndex, Wrap=False)
xy = XYPlane(Origin=Point(0, 0, 0))
mesh = Mesh(Vertices=replace, Faces=mcomp.Faces)
mirror = Mirror(Geometry=mesh, Plane=xy)  # -> Geometry, Transform
wbjoin = WeaverbirdsJoinMeshesAndWeld(Mesh=flatten([mirror.Geometry, mesh]), Weld=True)
mesh_2 = Mesh(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)
wbstellate = WeaverbirdsStellateCumulation(MeshPolylines=wbjoin, Distance=0)
mesh_3 = Mesh(wbstellate)
mcomp_2 = Decompose(Mesh=mesh_3)  # -> Vertices, Faces, Colours, Normals
springsfrommesh = SpringsFromMesh(M=mesh_3, stiffness=1000, B=1)
clean = CombineClean(Meshes=mesh_3)
collidemesh = CollideMesh(Solid=mesh_2, Points=mcomp_2.Vertices, Hardness=0.7, Traction=0.5)
meshpressure = MeshPressure(M=clean, pressurelevel=15)

timer = Timer(TimerInterval=20, Target=kangaroo)  # disabled

kangaroo = KangarooPhysics(
    ForceObjects=flatten([springsfrommesh, meshpressure, collidemesh]),
    Settings=null,
    Geometry=clean,
    SimulationReset=Button())  # -> Out, Iterations, ParticlesOut, GeometryOut
mesh_4 = Mesh(kangaroo.GeometryOut)

# ==== cluster MeshPressure: Applies pressure to a triangulated mesh
M = ClusterInput()
mcomp = Decompose(Mesh=M)  # -> Vertices, Faces, Colours, Normals
vertices = FaceVertices(Face=mcomp.Faces)  # -> CornerA, CornerB, CornerC, CornerD
item = ListItem(List=mcomp.Vertices, Index=vertices.CornerA, Wrap=False)
item_2 = ListItem(List=mcomp.Vertices, Index=vertices.CornerB, Wrap=False)
item_3 = ListItem(List=mcomp.Vertices, Index=vertices.CornerC, Wrap=False)
pressurelevel = ClusterInput()
pressure = Pressure(Point1=item, Point2=item_2, Point3=item_3, PressureLevel=pressurelevel)
P = ClusterOutput(pressure)

# ==== cluster SpringsFromMesh: Turns all edges of a mesh into springs
M = ClusterInput()
medges = MeshEdges(Mesh=M)  # -> NakedEdges, InteriorEdges, NonManifoldEdges
crv = Curve([medges.NakedEdges, medges.InteriorEdges])
B = ClusterInput()
len = Length(Curve=crv)
multiplication = Multiplication(A=len, B=B)
stiffness = ClusterInput()
springs = SpringsFromLine(Connection=crv, Stiffness=stiffness, Damping=10, RestLength=multiplication, UpperCutoff=0, LowerCutoff=0, Plasticity=0)
S = ClusterOutput(springs)
