# Grasshopper definition inflate.gh (Grasshopper 0.9.61)
# plug-ins: Kangaroo Components, Weaverbird

mesh = Mesh(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)
wbstellate = WeaverbirdsStellateCumulation(MeshPolylines=mesh, Distance="0")
meshpressure = MeshPressure(M=wbstellate, pressurelevel=15)
springsfrommesh = SpringsFromMesh(M=wbstellate, stiffness=1000, B=1)

timer = Timer(TimerInterval=20, Target=kangaroo)  # disabled

kangaroo = KangarooPhysics(ForceObjects=[meshpressure, springsfrommesh], Settings=null, Geometry=wbstellate, SimulationReset=Toggle(True))  # -> Out, Iterations, ParticlesOut, GeometryOut
mesh_2 = Mesh(kangaroo.GeometryOut)
preview = CustomPreview(
    Geometry=mesh_2,
    Shader={ambient=RGB(0, 0, 0), diffuse=RGB(255, 105, 180), emission=RGB(76, 32, 54), shine=0.5, specular=RGB(255, 255, 255), transparency=0})

# ==== cluster MeshPressure: Applies pressure to a triangulated mesh
M = ClusterInput()
mcomp = Decompose(Mesh=M)  # -> Vertices, Faces, Colours, Normals
vertices = FaceVertices(Face=mcomp.Faces)  # -> CornerA, CornerB, CornerC, CornerD
item = ListItem(List=mcomp.Vertices, Index=vertices.CornerA, Wrap=False)
item_2 = ListItem(List=mcomp.Vertices, Index=vertices.CornerB, Wrap=False)
item_3 = ListItem(List=mcomp.Vertices, Index=vertices.CornerC, Wrap=False)
pressurelevel = ClusterInput()
pressure = Pressure(Point1=item, Point2=item_2, Point3=item_3, PressureLevel=pressurelevel)
P = ClusterOutput(pressure)

# ==== cluster SpringsFromMesh: Turns all edges of a mesh into springs
M = ClusterInput()
medges = MeshEdges(Mesh=M)  # -> NakedEdges, InteriorEdges, NonManifoldEdges
crv = Curve([medges.NakedEdges, medges.InteriorEdges])
B = ClusterInput()
len = Length(Curve=crv)
multiplication = Multiplication(A=len, B=B)
stiffness = ClusterInput()
springs = SpringsFromLine(Connection=crv, Stiffness=stiffness, Damping=10, RestLength=multiplication, UpperCutoff=0, LowerCutoff=0, Plasticity=0)
S = ClusterOutput(springs)
