# Grasshopper definition pressure_volume.gh (Grasshopper 0.9.61)
# plug-ins: MeshEdit Components, Kangaroo Components

mesh = Mesh(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)
volume = MeshVolume(Mesh=mesh)  # -> Volume, Centroid
springsfrommesh = SpringsFromMesh(M=mesh, stiffness=20, B=Slider(0, range=0..1))
gasvolume = GasVolume(Mesh=mesh, Volume=volume.Volume, K=0.5)

timer = Timer(TimerInterval=20, Target=kangaroo)  # disabled

kangaroo = KangarooPhysics(ForceObjects=flatten([gasvolume, springsfrommesh]), Settings=null, Geometry=mesh, SimulationReset=Button())  # -> Out, Iterations, ParticlesOut, GeometryOut
mesh_2 = Mesh(kangaroo.GeometryOut)

# ==== cluster SpringsFromMesh: Turns all edges of a mesh into springs
M = ClusterInput()
medges = MeshEdges(Mesh=M)  # -> NakedEdges, InteriorEdges, NonManifoldEdges
crv = Curve([medges.NakedEdges, medges.InteriorEdges])
B = ClusterInput()
len = Length(Curve=crv)
multiplication = Multiplication(A=len, B=B)
stiffness = ClusterInput()
springs = SpringsFromLine(Connection=crv, Stiffness=stiffness, Damping=10, RestLength=multiplication, UpperCutoff=0, LowerCutoff=0, Plasticity=0)
S = ClusterOutput(springs)
