# Grasshopper definition Wind.gh (Grasshopper 0.9.61)
# plug-ins: Kangaroo Components

mesh = Mesh(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)
refine = Refine(Mesh=mesh, Level=1)
md_slider = MDSlider(slider_value=Point(1, 1, 0.5), SliderMode=0, x_domain=Domain(-10, 10), y_domain=Domain(-10, 10), z_domain=Domain(0, 1))
tri = Triangulate(Mesh=refine)  # -> Mesh, Count
springsfrommesh = SpringsFromMesh(M=tri.Mesh, stiffness=4000, B=1)
windmesh = WindMesh(M=tri.Mesh, wind=md_slider, relative=True, strength=5, waterline=0)

timer = Timer(TimerInterval=20, Target=kangaroo)  # disabled

pt = Point([Point(20, 0, 20), Point(20, 0, 35)])
kangaroo = KangarooPhysics(
    ForceObjects=flatten([windmesh, springsfrommesh]),
    AnchorPoints=pt,
    Settings=null,
    Geometry=refine,
    SimulationReset=Button())  # -> Out, Iterations, ParticlesOut, GeometryOut
mesh_2 = Mesh(kangaroo.GeometryOut)

# ==== cluster WindMesh: Applies wind to a mesh
M = ClusterInput()
mcomp = Decompose(Mesh=M)  # -> Vertices, Faces, Colours, Normals
vertices = FaceVertices(Face=mcomp.Faces)  # -> CornerA, CornerB, CornerC, CornerD
item = ListItem(List=mcomp.Vertices, Index=vertices.CornerA, Wrap=False)
item_2 = ListItem(List=mcomp.Vertices, Index=vertices.CornerB, Wrap=False)
item_3 = ListItem(List=mcomp.Vertices, Index=vertices.CornerC, Wrap=False)
wind = ClusterInput()
relative = ClusterInput()
strength = ClusterInput()
waterline = ClusterInput()
wind_2 = Wind(Point1=item, Point2=item_2, Point3=item_3, Wind=wind, Relative=relative, Strength=strength, Waterline=waterline)
W = ClusterOutput(wind_2)

# ==== cluster SpringsFromMesh: Turns all edges of a mesh into springs
M = ClusterInput()
medges = MeshEdges(Mesh=M)  # -> NakedEdges, InteriorEdges, NonManifoldEdges
crv = Curve([medges.NakedEdges, medges.InteriorEdges])
B = ClusterInput()
len = Length(Curve=crv)
multiplication = Multiplication(A=len, B=B)
stiffness = ClusterInput()
springs = SpringsFromLine(Connection=crv, Stiffness=stiffness, Damping=10, RestLength=multiplication, UpperCutoff=0, LowerCutoff=0, Plasticity=0)
S = ClusterOutput(springs)
