# Grasshopper definition 0099a_pull_to_mesh.gh (Grasshopper 0.9.61)
# plug-ins: Kangaroo Components

mesh = Mesh(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)
R = Region({Plane=PlaneXY(-9, -16, 0), X=Domain(0, 68), Y=Domain(0, 40), Z=Domain(0, 25)})
pop3d = Populate3D(Region=R, Count=100, Seed=1)
number_slider = Slider(5.248, range=1..10)
inter = InterconnectPoints(Pts=pop3d)
pulltomesh = PullToMesh(ConstraintMesh=mesh, Points=pop3d, PullStrength=100)
multiplication = Multiplication(A=number_slider, B=0.5)
springs = SpringsFromLine(
    Connection=inter,
    Stiffness=1000,
    Damping=10,
    RestLength=number_slider,
    UpperCutoff=number_slider,
    LowerCutoff=0,
    Plasticity=0)

timer = Timer(TimerInterval=20, Target=kangaroo)  # disabled

kangaroo = KangarooPhysics(ForceObjects=flatten([pulltomesh, springs]), Settings=null, SimulationReset=Toggle(False))  # -> Out, Iterations, ParticlesOut, GeometryOut
msphere = MeshSphere(Base=kangaroo.ParticlesOut, Radius=multiplication, UCount=8, VCount=16)
