# Grasshopper definition CircularMesh_targetsurface.gh (Grasshopper 0.9.61)
# plug-ins: Kangaroo Components, Weaverbird

mplane = MeshPlane(Boundary={Plane=PlaneXY(0, 0, 0), Size=Domain2(u=-10..10, v=-10..10)}, WidthCount=10, HeightCount=10)  # -> Mesh, Area
wbfacepolys = FacePolylines(Mesh=mplane.Mesh)
wbvertices = VerticesComponent(Mesh=mplane.Mesh, Weld=True)
explode = Explode(Curve=wbfacepolys, Recursive=True)  # -> Segments, Vertices
split = SplitList(List=explode.Vertices, Index=1)  # -> ListA, ListB
flip = FlipMatrix(Data=split.ListB)
srf = Surface(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)
avr = Average(Input=split.ListB)
bang = ExplodeTree(Data=flip)  # -> _0000, _0010, _0020, _0030
ln = Line(PointA=split.ListB, PointB=avr)
wbedges = MeshEdges(Mesh=mplane.Mesh, FaceOrder=False)
pulltosurf = PullToSurf(ConstraintSurface=srf, Points=wbvertices, PullStrength=500)
planarize = Planarize(Point1=bang._0000, Point2=bang._0010, Point3=bang._0020, Point4=bang._0030, PlanarizeStrength=3000)
equalizen = EqualizeN(Lines=ln, EqNStrength=6000)
springs = SpringsFromLine(
    Connection=wbedges,
    Stiffness=1000,
    Damping=10,
    RestLength=wbedges,
    Cutoff=0,
    CompressionFail=0,
    TensileFail=0,
    Plasticity=0)
springs_2 = SpringsFromLine(Connection=ln, Stiffness=100, Damping=10, RestLength=ln, Cutoff=0, CompressionFail=0, TensileFail=0, Plasticity=0)

timer = Timer(TimerInterval=1, Target=kangaroo)  # disabled

kangaroo = KangarooPhysics(
    ForceObjects=flatten([planarize, equalizen, springs_2, pulltosurf, springs]),
    Settings=null,
    Geometry=mplane.Mesh,
    SimulationReset=Toggle(False))  # -> Out, Iterations, ParticlesOut, GeometryOut
mcomp = Decompose(Mesh=kangaroo.GeometryOut)  # -> Vertices, Faces, Colours, Normals
mesh = Mesh(kangaroo.GeometryOut)
vertices = FaceVertices(Face=mcomp.Faces)  # -> CornerA, CornerB, CornerC, CornerD
item = ListItem(List=mcomp.Vertices, Index=vertices.CornerA, Wrap=False)
item_2 = ListItem(List=mcomp.Vertices, Index=vertices.CornerB, Wrap=False)
item_3 = ListItem(List=mcomp.Vertices, Index=vertices.CornerC, Wrap=False)
circle = Circle3Pt(PointA=item, PointB=item_2, PointC=item_3)  # -> Circle, Plane, Radius
