# Grasshopper definition Equalize_and_smooth.gh (Grasshopper 0.9.61)
# plug-ins: Kangaroo Components, Weaverbird

mesh = Mesh(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)
springs = Slider(0, range=0..5000)
edgebend = Slider(3200, range=0..5000)
equalize = Slider(512.5, range=0..5000)
smoothing = Slider(5000, range=0..5000)
wbtriangles = WeaverbirdsSplitTrianglesSubdivision(MeshCurves=mesh, Level="8")
wbjoin = WeaverbirdsJoinMeshesAndWeld(Mesh=wbtriangles, Weld=True)
faceb = FaceBoundaries(Mesh=wbjoin)
medges = MeshEdges(Mesh=wbjoin)  # -> NakedEdges, InteriorEdges, NonManifoldEdges
explode = Explode(Curve=faceb, Recursive=True)  # -> Segments, Vertices
# You can bake these points into Rhino
# and re-reference them in order to be
# able to move them.
# 
# Or you can choose some new points
# (as long as they coincide with vertices
# of the subdivided mesh)
pt = Point([Point(9, 78, 0), Point(34, 7, 0), Point(70, 29, 5)])
crv = Curve([medges.NakedEdges, medges.InteriorEdges])
edgebend_2 = EdgeBend(bendstrength=edgebend, M=wbjoin, B=0.3926990817)
equalizen = EqualizeN(Lines=explode.Segments, EqNStrength=equalize)
springs_2 = SpringsFromLine(
    Connection=crv,
    Stiffness=springs,
    Damping=10,
    RestLength=Slider(0.25, range=0..1),
    UpperCutoff=0,
    LowerCutoff=0,
    Plasticity=0)
smooth = MeshSmooth(mesh=wbjoin, strength=smoothing)

timer = Timer(TimerInterval=20, Target=kangaroo)  # disabled

kangaroo = KangarooPhysics(
    ForceObjects=flatten([smooth, edgebend_2, springs_2, equalizen]),
    AnchorPoints=pt,
    Settings=null,
    Geometry=wbjoin,
    SimulationReset=Toggle(True))  # -> Out, Iterations, ParticlesOut, GeometryOut
mesh_2 = Mesh(kangaroo.GeometryOut)

# ==== cluster MeshSmooth: Apply Laplacian Smoothing to a mesh
mesh = ClusterInput()
mesh_2 = Mesh(mesh)
nv = NakedVertices(Mesh=mesh_2)  # -> Clothed, Naked, ClothedPts, NakedPts
strength = ClusterInput()
vn = VertexNeighbours(Mesh=mesh_2, VertexNumber=nv.Clothed)  # -> Vertex, Neighbours, Normal
laplacian = Laplacian(Center=graft(vn.Vertex), Neighbours=vn.Neighbours, Strength=strength, Weighting=0)  # -> flatten(Laplacian)
L = ClusterOutput(laplacian)

# ==== cluster EdgeBend: Keeps the boundary of a mesh straight
M = ClusterInput()
medges = MeshEdges(Mesh=M)  # -> NakedEdges, InteriorEdges, NonManifoldEdges
join = JoinCurves(Curves=medges.NakedEdges, Preserve=False)
explode = Explode(Curve=join, Recursive=True)  # -> simplify(Segments), Vertices
shift = ShiftList(List=explode.Segments, Shift=1, Wrap=True)  # -> simplify(List)
end = EndPoints(Curve=explode.Segments)  # -> Start, End
end_2 = EndPoints(Curve=shift)  # -> Start, End
bendstrength = ClusterInput()
angle = Angle(VectorA=explode.Segments, VectorB=shift)  # -> Angle, Reflex
B = ClusterInput()
bend = Bend(Point1=end.Start, Point2=end.End, Point3=end_2.End, BendStrength=bendstrength, RestAngle=0)
smaller = SmallerThan(FirstNumber=angle.Angle, SecondNumber=B)  # -> SmallerThan, OrEqualTo
cull = CullPattern(List=bend, CullPattern=smaller.SmallerThan)  # -> flatten(List)
L = ClusterOutput(cull)
