# Grasshopper definition QuadPlanarization.gh (Grasshopper 0.9.61)
# plug-ins: Kangaroo Components

# By gradually reducing the strength of all
# the other forces relative to the
# planarization, the constraint can be
# enforced more precisely
number_slider = Slider(1, range=0..1)
mesh = Mesh(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)
quaddiv = QuadDivide(Mesh=mesh, Divisions=7)
strength = Strength(3000)
stiffness = Stiffness(1000)
multiplication = Multiplication(A=strength, B=number_slider)
multiplication_2 = Multiplication(A=stiffness, B=number_slider)
toggle = BooleanToggle(False)
pt = Point([Point(20, 30, 0), Point(20, 40, 0), Point(21.4285717, 30, 0), Point(21.4285717, 40, 0), Point(22.8571434, 30, 0), Point(22.8571434, 40, 0)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])
springsfrommesh = SpringsFromMesh(M=quaddiv, stiffness=multiplication_2, B=1)
planarizequads = PlanarizeQuads(M=quaddiv, planarizestrength=1000)
smooth = MeshSmooth(mesh=quaddiv, strength=multiplication)
anchorxyz = AnchorXYZ(Point=pt, ConstrainX=toggle, ConstrainY=toggle, ConstrainZ=Toggle(True))
eqnstrength = EqNStrength(100)
multiplication_3 = Multiplication(A=eqnstrength, B=number_slider)

# ---- group: equalize diagonals
mcomp = Decompose(Mesh=quaddiv)  # -> Vertices, Faces, Colours, Normals
vertices = FaceVertices(Face=mcomp.Faces)  # -> CornerA, CornerB, CornerC, CornerD
item = ListItem(List=mcomp.Vertices, Index=vertices.CornerA, Wrap=False)
item_2 = ListItem(List=mcomp.Vertices, Index=vertices.CornerB, Wrap=False)
item_3 = ListItem(List=mcomp.Vertices, Index=vertices.CornerC, Wrap=False)
item_4 = ListItem(List=mcomp.Vertices, Index=vertices.CornerD, Wrap=False)
ln = Line(StartPoint=item_2, EndPoint=item_4)  # -> graft(Line)
ln_2 = Line(StartPoint=item, EndPoint=item_3)  # -> graft(Line)
equalizen = EqualizeN(Lines=[ln_2, ln], EqNStrength=multiplication_3)

# ----
timer = Timer(TimerInterval=20, Target=kangaroo)  # disabled

kangaroo = KangarooPhysics(
    ForceObjects=flatten([planarizequads, springsfrommesh, smooth, anchorxyz, equalizen]),
    Settings=null,
    Geometry=quaddiv,
    SimulationReset=Toggle(False))  # -> Out, Iterations, ParticlesOut, GeometryOut
mesh_2 = Mesh(kangaroo.GeometryOut)
planaritydisplay = PlanarityDisplay(M=mesh_2, I=Domain(0, 0.05), bool=True)  # -> num_2, M_2, C
preview = CustomPreview(Geometry=planaritydisplay.M_2, Shader=planaritydisplay.C)

# ==== cluster PlanarizeQuads: Applies a planarization force to each face of a quad mesh
M = ClusterInput()
mcomp = Decompose(Mesh=M)  # -> Vertices, Faces, Colours, Normals
vertices = FaceVertices(Face=mcomp.Faces)  # -> CornerA, CornerB, CornerC, CornerD
item = ListItem(List=mcomp.Vertices, Index=vertices.CornerA, Wrap=False)
item_2 = ListItem(List=mcomp.Vertices, Index=vertices.CornerB, Wrap=False)
item_3 = ListItem(List=mcomp.Vertices, Index=vertices.CornerC, Wrap=False)
item_4 = ListItem(List=mcomp.Vertices, Index=vertices.CornerD, Wrap=False)
planarizestrength = ClusterInput()
planarize = Planarize(Point1=item, Point2=item_2, Point3=item_3, Point4=item_4, PlanarizeStrength=planarizestrength)
P = ClusterOutput(planarize)

# ==== cluster MeshSmooth: Apply Laplacian Smoothing to a mesh
mesh = ClusterInput()
mesh_2 = Mesh(mesh)
nv = NakedVertices(Mesh=mesh_2)  # -> Clothed, Naked, ClothedPts, NakedPts
strength = ClusterInput()
vn = VertexNeighbours(Mesh=mesh_2, VertexNumber=nv.Clothed)  # -> Vertex, Neighbours, Normal
laplacian = Laplacian(Center=graft(vn.Vertex), Neighbours=vn.Neighbours, Strength=strength, Weighting=0)  # -> flatten(Laplacian)
L = ClusterOutput(laplacian)

# ==== cluster SpringsFromMesh: Turns all edges of a mesh into springs
M = ClusterInput()
medges = MeshEdges(Mesh=M)  # -> NakedEdges, InteriorEdges, NonManifoldEdges
crv = Curve([medges.NakedEdges, medges.InteriorEdges])
B = ClusterInput()
len = Length(Curve=crv)
multiplication = Multiplication(A=len, B=B)
stiffness = ClusterInput()
springs = SpringsFromLine(Connection=crv, Stiffness=stiffness, Damping=10, RestLength=multiplication, UpperCutoff=0, LowerCutoff=0, Plasticity=0)
S = ClusterOutput(springs)

# ==== cluster PlanarityDisplay: Creates colours for each face of a mesh, showing planarity levels
I = ClusterInput()
M = ClusterInput()
bool = ClusterInput()
domcomp = DomainComponents(Domain=I)  # -> Start, End
mcomp = Decompose(Mesh=M)  # -> Vertices, Faces, Colours, Normals
bool_2 = Boolean(bool)
vertices = FaceVertices(Face=mcomp.Faces)  # -> CornerA, CornerB, CornerC, CornerD
item = ListItem(List=mcomp.Vertices, Index=vertices.CornerA, Wrap=False)
item_2 = ListItem(List=mcomp.Vertices, Index=vertices.CornerB, Wrap=False)
item_3 = ListItem(List=mcomp.Vertices, Index=vertices.CornerC, Wrap=False)
item_4 = ListItem(List=mcomp.Vertices, Index=vertices.CornerD, Wrap=False)
quad = MeshQuad(CornerA=0, CornerB=1, CornerC=3, CornerD=2)
entwine = Entwine(Branch00=item, Branch01=item_2, Branch02=item_4, Branch03=item_3)
flip = FlipMatrix(Data=entwine)
dist = Distance(PointA=item_2, PointB=item_4)
dist_2 = Distance(PointA=item, PointB=item_3)
P = Planarity(Point1=item, Point2=item_2, Point3=item_3, Point4=item_4)  # -> flatten(Height)
mesh = Mesh(Vertices=flip, Faces=quad)  # -> flatten(Mesh)
avr = Average(Input=[dist_2, dist])  # -> flatten(ArithmeticMean)
M_2 = ClusterOutput(mesh)
division = Division(A=P, B=avr)
filter = StreamFilter(Gate=bool_2, Stream0=division, Stream1=P)  # -> flatten(Stream)
gradient = Gradient(
    LowerLimit=domcomp.Start,
    UpperLimit=domcomp.End,
    Parameter=filter,
    stops=[0: RGB(0, 128, 0), 0.5: RGB(255, 255, 0), 1: RGB(255, 0, 0)])
num = Number(filter)
C = ClusterOutput(gradient)
num_2 = ClusterOutput(num)
