# Grasshopper definition developable_strips_unrolling.gh (Grasshopper 0.9.75)
# plug-ins: MeshEdit Components, Kangaroo Components

# ---- group: For the later part of the definition to work this must be a vertex with only EVEN valence vertices
# See here for more info:
# 
# http://www.grasshopper3d.com/group/kangaroo/forum/topics/new-tutorial-developable-strips-part-1
mesh = Mesh(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)

# ----
refine = Refine(Mesh=mesh, Level=2)
L = Level(3)
md = MeshDirection(Mesh=refine)
strips = RefineStrips(Mesh=md, Level=L)

medges = MeshEdges(Mesh=strips)  # -> NakedEdges, InteriorEdges, NonManifoldEdges
join = JoinCurves(Curves=medges.NakedEdges, Preserve=False)
explode = Explode(Curve=join, Recursive=True)  # -> Segments, Vertices
end = EndPoints(Curve=explode.Segments)  # -> Start, End
plfit = PlaneFit(Points=end.Start)  # -> Plane, Deviation
avr = Average(Input=end.Start)
len = Length(Curve=explode.Segments)
mesh_2 = Mesh(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)
pl_origin = PlaneOrigin(Base=plfit.Plane, Origin=avr)
multiplication = Multiplication(A=len, B=Slider(1.925, range=0..3))
orient = Orient(Geometry=mesh_2, Source=PlaneXY(0, 0, 0), Target=pl_origin)  # -> Geometry, Transform
edgebend = EdgeBend(bendstrength=2000, M=strips, B=3.141592654)
pulltomesh = PullToMesh(ConstraintMesh=orient.Geometry, Points=end.Start, PullStrength=1000)
springs = SpringsFromLine(
    Connection=explode.Segments,
    Stiffness=2000,
    Damping=10,
    RestLength=multiplication,
    UpperCutoff=0,
    LowerCutoff=0,
    Plasticity=0)

# ---- group: split into warp/weft directions
warpweft = WarpWeft(Mesh=strips)  # -> Warp, Weft, NakedA, NakedB

# ---- group: different spring stiffnesses needed to account for different subdivision density
stiffness = Stiffness(1)
stiffness_2 = Stiffness(200)

# ---- group: thin planar quads give developable strips
planarizequads = PlanarizeQuads(M=strips, planarizestrength=3000)

# ----
springs_2 = SpringsFromLine(Connection=warpweft.Warp, Stiffness=stiffness, Damping=10, RestLength=0, UpperCutoff=0, LowerCutoff=0, Plasticity=0)
springs_3 = SpringsFromLine(Connection=warpweft.Weft, Stiffness=stiffness_2, Damping=10, RestLength=0, UpperCutoff=0, LowerCutoff=0, Plasticity=0)

timer = Timer(TimerInterval=20, Target=kangaroo)

kangaroo = KangarooPhysics(
    ForceObjects=flatten([springs_2, springs, edgebend, pulltomesh, springs_3, planarizequads]),
    Settings=null,
    Geometry=strips,
    SimulationReset=Button())  # -> Out, Iterations, ParticlesOut, GeometryOut
mesh_3 = Mesh(kangaroo.GeometryOut)
dam = DataDam(DataA=mesh_3, BufferDelay=10000000, BufferMode=0)

# ---- group: divide into strips
# Data Dams can be used
# to avoid having the
# whole layout process
# recalculate continuously
# as Kangaroo is solving.
stripper = Stripper(Mesh=dam)

# ----
unroller = Unroller(Strip=stripper, Unroll=Slider(1, range=0..1))  # -> graft(Unrolled)
dam_2 = DataDam(DataA=unroller, BufferDelay=10000000, BufferMode=0)

# ---- group: laying out
explode_2 = MeshExplode(Mesh=dam_2, Interpolate=False)
item = ListItem(List=explode_2, Index=0, Wrap=True)
item_2 = ListItem(List=explode_2, Index=-1, Wrap=True)
facen = FaceNormals(Mesh=item)  # -> Centers, Normals
facen_2 = FaceNormals(Mesh=item_2)  # -> Centers, Normals
pl = PlaneNormal(Origin=facen.Centers, ZAxis=facen.Normals)
vec2pt = Vector2Pt(PointA=facen.Centers, PointB=facen_2.Centers, Unitize=False)  # -> Vector, Length
align = AlignPlane(Plane=pl, Direction=vec2pt.Vector)  # -> flatten(Plane), Angle
bbox = BoundingBox(Content=dam_2, Plane=graft(align.Plane))  # -> flatten(Box), Box_2
box_corners = BoxCorners(Box=bbox.Box)  # -> CornerA, CornerB, CornerC, CornerD, CornerE, CornerF, CornerG, CornerH
pl_origin_2 = PlaneOrigin(Base=align.Plane, Origin=box_corners.CornerD)
debox = DeconstructBox(Box=bbox.Box)  # -> Plane, X, Y, Z
dedomain = DeconstructDomain(Domain=debox.Y)  # -> Start, End
subtraction = Subtraction(A=dedomain.End, B=dedomain.Start)
ma = MassAddition(Input=subtraction)  # -> Result, PartialResults
xy = XYPlane(Origin=Point(0, 0, 0))
X = UnitX(Factor=ma.PartialResults)
rotate = Rotate(Geometry=xy, Angle=1.570796327, Plane=PlaneXY(0, 0, 0))  # -> Geometry, Transform
neg = Negative(Value=X)
move = Move(Geometry=rotate.Geometry, Motion=neg)  # -> Geometry, Transform
pln = Plane(move.Geometry)

# ----
orient_2 = Orient(Geometry=flatten(dam_2), Source=pl_origin_2, Target=pln)  # -> Geometry, Transform
mesh_4 = Mesh(orient_2.Geometry)

# ==== cluster EdgeBend: Keeps the boundary of a mesh straight
M = ClusterInput()
medges = MeshEdges(Mesh=M)  # -> NakedEdges, InteriorEdges, NonManifoldEdges
join = JoinCurves(Curves=medges.NakedEdges, Preserve=False)
explode = Explode(Curve=join, Recursive=True)  # -> simplify(Segments), Vertices
shift = ShiftList(List=explode.Segments, Shift=1, Wrap=True)  # -> simplify(List)
end = EndPoints(Curve=explode.Segments)  # -> Start, End
end_2 = EndPoints(Curve=shift)  # -> Start, End
bendstrength = ClusterInput()
angle = Angle(VectorA=explode.Segments, VectorB=shift)  # -> Angle, Reflex
B = ClusterInput()
bend = Bend(Point1=end.Start, Point2=end.End, Point3=end_2.End, BendStrength=bendstrength, RestAngle=0)
smaller = SmallerThan(FirstNumber=angle.Angle, SecondNumber=B)  # -> SmallerThan, OrEqualTo
cull = CullPattern(List=bend, CullPattern=smaller.SmallerThan)  # -> flatten(List)
L = ClusterOutput(cull)

# ==== cluster PlanarizeQuads: Applies a planarization force to each face of a quad mesh
M = ClusterInput()
mcomp = Decompose(Mesh=M)  # -> Vertices, Faces, Colours, Normals
vertices = FaceVertices(Face=mcomp.Faces)  # -> CornerA, CornerB, CornerC, CornerD
item = ListItem(List=mcomp.Vertices, Index=vertices.CornerA, Wrap=False)
item_2 = ListItem(List=mcomp.Vertices, Index=vertices.CornerB, Wrap=False)
item_3 = ListItem(List=mcomp.Vertices, Index=vertices.CornerC, Wrap=False)
item_4 = ListItem(List=mcomp.Vertices, Index=vertices.CornerD, Wrap=False)
planarizestrength = ClusterInput()
planarize = Planarize(Point1=item, Point2=item_2, Point3=item_3, Point4=item_4, PlanarizeStrength=planarizestrength)
P = ClusterOutput(planarize)
