# Grasshopper definition 0081Mesh_drape.gh (Grasshopper 0.9.61)
# plug-ins: Kangaroo Components

mesh = Mesh(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)

# ---- group: sphere
# Must be a closed solid mesh
mesh_2 = Mesh(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)

# ----
quaddiv = QuadDivide(Mesh=mesh, Divisions="12")
mcomp = Decompose(Mesh=quaddiv)  # -> Vertices, Faces, Colours, Normals
springsfrommesh = SpringsFromMesh(M=quaddiv, stiffness=1000, B=1)
gravity = Gravity(M=quaddiv, F="-10")
collidemesh = CollideMesh(Solid=mesh_2, Points=mcomp.Vertices, Hardness=0.7, Traction=0.5)

timer = Timer(TimerInterval=20, Target=kangaroo)  # disabled

kangaroo = KangarooPhysics(
    ForceObjects=flatten([springsfrommesh, gravity, collidemesh]),
    Settings=null,
    Geometry=quaddiv,
    SimulationReset=Toggle(True))  # -> Out, Iterations, ParticlesOut, GeometryOut
mesh_3 = Mesh(kangaroo.GeometryOut)

# ==== cluster SpringsFromMesh: Turns all edges of a mesh into springs
M = ClusterInput()
medges = MeshEdges(Mesh=M)  # -> NakedEdges, InteriorEdges, NonManifoldEdges
crv = Curve([medges.NakedEdges, medges.InteriorEdges])
B = ClusterInput()
len = Length(Curve=crv)
multiplication = Multiplication(A=len, B=B)
stiffness = ClusterInput()
springs = SpringsFromLine(
    Connection=crv,
    Stiffness=stiffness,
    Damping=10,
    RestLength=multiplication,
    Cutoff=0,
    CompressionFail=0,
    TensileFail=0,
    Plasticity=0)
S = ClusterOutput(springs)

# ==== cluster Gravity: Apply gravity to vertices of a mesh
M = ClusterInput()
F = ClusterInput()
mcomp = Decompose(Mesh=M)  # -> Vertices, Faces, Colours, Normals
Z = UnitZ(Factor=F)
duppt = RemoveDuplicatePts(Points=mcomp.Vertices, Tolerance=0.01)
uforce = UnaryForce(Point=duppt, Force=Z)
U = ClusterOutput(uforce)
