# Grasshopper definition 0096sphere_pile.gh (Grasshopper 0.9.75)
# plug-ins: Kangaroo Components

slider = Slider(0.429, range=0..1)
pop2d = Populate2D(Region={Plane=PlaneXZ(7, 0, 4), Size=Domain2(u=0..22, v=0..17)}, Count="250", Seed=1)
Z = UnitZ(Factor=-5)
# Compare this with the other definition "fastcollisions_sphere_pile"
addition = Addition(A=slider, B=slider)
inter = InterconnectPoints(Pts=pop2d)
kangaroo_settings = KangarooSettings(
    Tolerance=0.001,
    TimeStep=0.01,
    SubIterations=10,
    Floor=Toggle(True),
    Drag=1,
    Restitution=0.7,
    StaticFriction=0,
    KineticFriction=0,
    Settle=0,
    Tumble=0,
    Sound=False,
    Solver=0)
uforce = UnaryForce(Point=pop2d, Force=Z)
springs = SpringsFromLine(Connection=inter, Stiffness=1000, Damping=10, RestLength=addition, UpperCutoff=addition, LowerCutoff=0, Plasticity=0)

timer = Timer(TimerInterval=1, Target=kangaroo)

kangaroo = KangarooPhysics(ForceObjects=flatten([springs, uforce]), Settings=kangaroo_settings, SimulationReset=Toggle(True))  # -> Out, Iterations, ParticlesOut, GeometryOut
xz = XZPlane(Origin=kangaroo.ParticlesOut)
cir = Circle(Plane=xz, Radius=slider)
