# Grasshopper definition 0098sphere_fall_into_mesh.gh (Grasshopper 0.9.61)
# plug-ins: Kangaroo Components

W = WidthCount(15)
mplane = MeshPlane(Boundary={Plane=PlaneXY(0, 0, 0), Size=Domain2(u=-10..10, v=-10..10)}, WidthCount=W, HeightCount=W)  # -> Mesh, Area
pt = Point(Point(0, 0, 10))
mcomp = Decompose(Mesh=mplane.Mesh)  # -> Vertices, Faces, Colours, Normals
springsfrommesh = SpringsFromMesh(M=mplane.Mesh, stiffness=1000, B=1)
Z = UnitZ(Factor="-200")
ln = Line(StartPoint=mcomp.Vertices, EndPoint=pt)
uforce = UnaryForce(Point=pt, Force=Z)
springs = SpringsFromLine(Connection=ln, Stiffness=1000, Damping=10, RestLength="5", UpperCutoff="5", LowerCutoff=0, Plasticity=0)
particle = Particle(Point=pt, Mass=100, Velocity=Vector(0, 0, 0))

timer = Timer(TimerInterval=20, Target=kangaroo)  # disabled

entwine = Entwine(Branch00=mplane.Mesh, Branch01=pt)
kangaroo = KangarooPhysics(
    ForceObjects=flatten([springs, uforce, particle, springsfrommesh]),
    Settings=null,
    Geometry=entwine,
    SimulationReset=Toggle(False))  # -> Out, Iterations, ParticlesOut, GeometryOut
bang = ExplodeTree(Data=kangaroo.GeometryOut)  # -> Branch0, Branch1
msphere = MeshSphere(Base=bang.Branch1, Radius="5", UCount=10, VCount=20)
mesh = Mesh(bang.Branch0)

# ==== cluster SpringsFromMesh: Turns all edges of a mesh into springs
M = ClusterInput()
medges = MeshEdges(Mesh=M)  # -> NakedEdges, InteriorEdges, NonManifoldEdges
crv = Curve([medges.NakedEdges, medges.InteriorEdges])
B = ClusterInput()
len = Length(Curve=crv)
multiplication = Multiplication(A=len, B=B)
stiffness = ClusterInput()
springs = SpringsFromLine(Connection=crv, Stiffness=stiffness, Damping=10, RestLength=multiplication, UpperCutoff=0, LowerCutoff=0, Plasticity=0)
S = ClusterOutput(springs)
