# Grasshopper definition Fast_fabric_self_collision_scarfdrop.gh (Grasshopper 0.9.75)
# plug-ins: Kangaroo Components

mesh = Mesh(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)
kangaroo_settings = KangarooSettings(
    Tolerance=0.001,
    TimeStep=0.01,
    SubIterations=10,
    Floor=True,
    Drag=1,
    Restitution=0.7,
    StaticFriction=10,
    KineticFriction=10,
    Settle=2,
    Tumble=1,
    Sound=False,
    Solver=0)
demesh = DeconstructMesh(Mesh=mesh)  # -> Vertices, Faces, Colours, Normals
uforce = UnaryForce(Point=demesh.Vertices, Force=Vector(0, 0, -9.8))
sc = SphereCollide(Centers=demesh.Vertices, Radius=0.5)
springsfrommesh = SpringsFromMesh(M=mesh, stiffness=1000, B=1)
kangaroo = KangarooPhysics(ForceObjects=flatten([sc, uforce, springsfrommesh]), Settings=kangaroo_settings, Geometry=mesh, SimulationReset=True)  # -> Out, Iterations, ParticlesOut, GeometryOut
mesh_2 = Mesh(kangaroo.GeometryOut)

# ==== cluster SpringsFromMesh: Turns all edges of a mesh into springs
M = ClusterInput()
medges = MeshEdges(Mesh=M)  # -> NakedEdges, InteriorEdges, NonManifoldEdges
crv = Curve([medges.NakedEdges, medges.InteriorEdges])
B = ClusterInput()
len = Length(Curve=crv)
multiplication = Multiplication(A=len, B=B)
stiffness = ClusterInput()
springs = SpringsFromLine(Connection=crv, Stiffness=stiffness, Damping=10, RestLength=multiplication, UpperCutoff=0, LowerCutoff=0, Plasticity=0)
S = ClusterOutput(springs)
