# Grasshopper definition Fastcollisions_sphere_pile.gh (Grasshopper 0.9.75)
# plug-ins: Kangaroo Components

slider = Slider(0.429, range=0..1)
pop2d = Populate2D(Region={Plane=PlaneXZ(7, 0, 4), Size=Domain2(u=0..22, v=0..17)}, Count="250", Seed=1)
Z = UnitZ(Factor=-5)
kangaroo_settings = KangarooSettings(
    Tolerance=0.001,
    TimeStep=0.01,
    SubIterations=10,
    Floor=Toggle(True),
    Drag=1,
    Restitution=0.7,
    StaticFriction=0,
    KineticFriction=0,
    Settle=0,
    Tumble=0,
    Sound=False,
    Solver=0)
sc = SphereCollide(Centers=pop2d, Radius=slider)
uforce = UnaryForce(Point=pop2d, Force=Z)

timer = Timer(TimerInterval=1, Target=kangaroo)

kangaroo = KangarooPhysics(ForceObjects=flatten([uforce, sc]), Settings=kangaroo_settings, SimulationReset=Toggle(True))  # -> Out, Iterations, ParticlesOut, GeometryOut
xz = XZPlane(Origin=kangaroo.ParticlesOut)
cir = Circle(Plane=xz, Radius=slider)
