# Grasshopper definition Line_line_collisions.gh (Grasshopper 0.9.61)
# plug-ins: Kangaroo Components

crv = Curve([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])
crossref = CrossReference(ListA=crv, ListB=crv, CrossMode=5)  # -> ListA, ListB
crv_2 = Curve(crossref.ListA)
crv_3 = Curve(crossref.ListB)
end = EndPoints(Curve=crv)  # -> Start, End
end_2 = EndPoints(Curve=crv_2)  # -> Start, End
end_3 = EndPoints(Curve=crv_3)  # -> Start, End
connection = Connection(crv)
# This works similarly to
# rest length / cutoff
# for springs
offset = Offset(1)
l1start = L1Start(end_2.Start)
l1end = L1End(end_2.End)
l2start = L2Start(end_3.Start)
l2end = L2End(end_3.End)
lineline = LineLine(
    L1Start=l1start,
    L1End=l1end,
    L2Start=l2start,
    L2End=l2end,
    Strength=1000,
    UpperCutoff=offset,
    LowerCutoff=0,
    Offset=offset,
    Exponent=1)
springs = SpringsFromLine(Connection=connection, Stiffness=1000, Damping=10, RestLength=connection, UpperCutoff=0, LowerCutoff=0, Plasticity=0)
pt = Point([end.Start, end.End])
uforce = UnaryForce(Point=pt, Force=Vector(0, 0, -10))
kangaroo_settings = KangarooSettings(
    Tolerance=0.001,
    TimeStep=0.01,
    SubIterations=20,
    Floor=True,
    Drag=3,
    Restitution=0.7,
    StaticFriction=10,
    KineticFriction=10,
    Settle=2,
    Tumble=1,
    Sound=False,
    Solver=0)

timer = Timer(TimerInterval=1, Target=kangaroo)  # disabled

kangaroo = KangarooPhysics(
    ForceObjects=flatten([lineline, springs, uforce]),
    Settings=kangaroo_settings,
    Geometry=connection,
    SimulationReset=Button())  # -> Out, Iterations, ParticlesOut, GeometryOut
# "Mesh Pipe" is also a useful alternative
# for faster display of pipes. You can find the plugin here :
# 
# http://www.grasshopper3d.com/forum/topics/mesh-pipe
R = Radius(0.5)
pipe = Pipe(Curve=kangaroo.GeometryOut, Radius=R, Caps=0)
