# Grasshopper definition 0097a_circlepacking_uniformradius.gh (Grasshopper 0.9.61)
# plug-ins: Kangaroo Components

pop2d = Populate2D(Region={Plane=PlaneXY(10, 10, 0), Size=Domain2(u=0..30, v=0..30)}, Count=100, Seed=1)
number_slider = Slider(1, range=0..1)
inter = InterconnectPoints(Pts=pop2d)
plaw = PowerLaw(Connection=inter, Exponents="-1", Strength="-1", Cutoff=0)
springs = SpringsFromLine(
    Connection=inter,
    Stiffness=3000,
    Damping=10,
    RestLength=number_slider,
    UpperCutoff=number_slider,
    LowerCutoff=0,
    Plasticity=0)

timer = Timer(TimerInterval=20, Target=kangaroo)  # disabled

kangaroo = KangarooPhysics(ForceObjects=flatten([springs, plaw]), Settings=null, SimulationReset=Button())  # -> Out, Iterations, ParticlesOut, GeometryOut
multiplication = Multiplication(A=number_slider, B="0.5")
cir = Circle(Plane=kangaroo.ParticlesOut, Radius=multiplication)
