# Grasshopper definition 0097b_circlepacking_randomradius.gh (Grasshopper 0.9.61)
# plug-ins: Kangaroo Components

N = Count(150)
random = Random(Range="1 to 5", Number=N, Seed=4)
pop2d = Populate2D(Region={Plane=PlaneXY(0, 0, 0), Size=Domain2(u=0..100, v=0..100)}, Count=N, Seed=1)
crossref = CrossReference(ListA=pop2d, ListB=pop2d, CrossMode=5)  # -> ListA, ListB
crossref_2 = CrossReference(ListA=random, ListB=random, CrossMode=5)  # -> ListA, ListB
ln = Line(StartPoint=crossref.ListA, EndPoint=crossref.ListB)
addition = Addition(A=crossref_2.ListA, B=crossref_2.ListB)
springs = SpringsFromLine(Connection=ln, Stiffness=1000, Damping=10, RestLength=addition, UpperCutoff=addition, LowerCutoff=0, Plasticity=0)
plaw = PowerLaw(Connection=ln, Exponents="-1", Strength="-10", Cutoff=0)

timer = Timer(TimerInterval=20, Target=kangaroo)  # disabled

kangaroo = KangarooPhysics(ForceObjects=flatten([springs, plaw]), Settings=null, SimulationReset=Button())  # -> Out, Iterations, ParticlesOut, GeometryOut
cir = Circle(Plane=kangaroo.ParticlesOut, Radius=random)
