# Grasshopper definition 0099b_tangent_circles.gh (Grasshopper 0.9.61)
# plug-ins: Kangaroo Components

pop2d = Populate2D(Region={Plane=PlaneXY(0, 0, 0), Size=Domain2(u=0..20, v=0..10)}, Count=100, Seed=1)
del = DelaunayMesh(Points=pop2d, Plane=PlaneXY(0, 0, 0))
springsfrommesh = SpringsFromMesh(M=del, stiffness=0.1, B=1)

timer = Timer(TimerInterval=20, Target=kangaroo)  # disabled

cpmesh = CPMesh(M=del, strength=500)
kangaroo = KangarooPhysics(ForceObjects=[springsfrommesh, cpmesh], Settings=null, Geometry=del, SimulationReset=Button())  # -> Out, Iterations, ParticlesOut, GeometryOut
tangentcircles = TangentCircles(mesh=kangaroo.GeometryOut)
faceb = FaceBoundaries(Mesh=kangaroo.GeometryOut)
explode = Explode(Curve=faceb, Recursive=True)  # -> Segments, Vertices
circle = Circle(tangentcircles)
item = ListItem(List=explode.Vertices, Index=0, Wrap=True)  # -> Item, Item1, Item2
incircle = InCircle(CornerA=item.Item, CornerB=item.Item1, CornerC=item.Item2)  # -> Circle, Plane, Radius

# ==== cluster CPMesh: Optimize a mesh towards a CP mesh ( tangent incircles )
M = ClusterInput()
c_script = CSharpScript(M=M)  # -> out, A, B, C, D; inputs M: Mesh
# ---------- c_script: C# ----------
    //your code here…

    if (M != null)
    {
      List < Point3d > EdgeEnd1 = new List<Point3d>();
      List < Point3d > EdgeEnd2 = new List<Point3d>();
      List < Point3d > Tip1 = new List<Point3d>();
      List < Point3d > Tip2 = new List<Point3d>();
      M.Faces.ConvertQuadsToTriangles();
      Point3d[] VertexPts = M.Vertices.ToPoint3dArray();

      for (int i = 0; i < M.TopologyEdges.Count; i++)
      {
        int[] ConnectedFaces = M.TopologyEdges.GetConnectedFaces(i);

        if (ConnectedFaces.Length == 2)
        {
          EdgeEnd1.Add(M.TopologyEdges.EdgeLine(i).From);
          EdgeEnd2.Add(M.TopologyEdges.EdgeLine(i).To);

          int[] adjacentface1points = M.TopologyVertices.IndicesFromFace(ConnectedFaces[0]);
          int[] adjacentface2points = M.TopologyVertices.IndicesFromFace(ConnectedFaces[1]);
          IndexPair EndTopologyVertices = M.TopologyEdges.GetTopologyVertices(i);

          for (int j = 0; j < 3; j++)
          {
            if (adjacentface1points[j] != EndTopologyVertices.I)
            {
              if (adjacentface1points[j] != EndTopologyVertices.J)
              {
                int Tip1TopologyVertex = adjacentface1points[j];
                int[] Tip1VertexIndex = M.TopologyVertices.MeshVertexIndices(Tip1TopologyVertex);
                Tip1.Add(VertexPts[Tip1VertexIndex[0]]);
              }
            }
            if (adjacentface2points[j] != EndTopologyVertices.I)
            {
              if (adjacentface2points[j] != EndTopologyVertices.J)
              {
                int Tip2TopologyVertex = adjacentface2points[j];
                int[] Tip2VertexIndex = M.TopologyVertices.MeshVertexIndices(Tip2TopologyVertex);
                Tip2.Add(VertexPts[Tip2VertexIndex[0]]);
              }
            }
          }
        }
      }
      A = EdgeEnd1;
      B = EdgeEnd2;
      C = Tip1;
      D = Tip2;
    }
# ---------- end c_script ----------
strength = ClusterInput()
tanincirc = TangentIncircles(Point1=c_script.A, Point2=c_script.B, Point3=c_script.C, Point4=c_script.D, Strength=strength)
T = ClusterOutput(tanincirc)

# ==== cluster SpringsFromMesh: Turns all edges of a mesh into springs
M = ClusterInput()
medges = MeshEdges(Mesh=M)  # -> NakedEdges, InteriorEdges, NonManifoldEdges
crv = Curve([medges.NakedEdges, medges.InteriorEdges])
B = ClusterInput()
len = Length(Curve=crv)
multiplication = Multiplication(A=len, B=B)
stiffness = ClusterInput()
springs = SpringsFromLine(Connection=crv, Stiffness=stiffness, Damping=10, RestLength=multiplication, UpperCutoff=0, LowerCutoff=0, Plasticity=0)
S = ClusterOutput(springs)

# ==== cluster TangentCircles: A compact circle packing from a flat mesh
mesh = ClusterInput()
mesh_2 = Mesh(mesh)
nv = NakedVertices(Mesh=mesh_2)  # -> ClothedIndex, NakedIndex, ClothedPts, NakedPts
vn = VertexNeighbours(Mesh=mesh_2, VertexNumber=nv.ClothedIndex)  # -> graft(Vertex), Neighbours, Normal
item = ListItem(List=vn.Neighbours, Index=0, Wrap=True)  # -> Item, Item1
dist = Distance(PointA=item.Item, PointB=item.Item1)
dist_2 = Distance(PointA=vn.Vertex, PointB=[item.Item, item.Item1])
ma = MassAddition(Input=[dist_2, dist])  # -> Result, PartialResults
multiplication = Multiplication(A=ma.Result, B=0.5)
pl = PlaneNormal(Origin=vn.Vertex, ZAxis=graft(vn.Normal))
subtraction = Subtraction(A=multiplication, B=dist)
cir = Circle(Plane=pl, Radius=subtraction)  # -> flatten(Circle)
C = ClusterOutput(cir)
