# Grasshopper definition compact_circle_packing_on_surface.gh (Grasshopper 0.9.75)
# plug-ins: Kangaroo Components, Weaverbird

mesh = Mesh(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)
wbjoin = WeaverbirdsJoinMeshesAndWeld(Mesh=mesh, Weld=True)
timer = Timer(TimerInterval=20, Target=kangaroo)
# Compact circle packing on a surface. A simila result can also be achieved using the TangentIncircles component.
wbdual = WeaverbirdsDualGraph(MeshCurves=wbjoin, DualMode=0)
pcen = PolygonCenter(Polyline=wbdual)  # -> CenterV, CenterE
explode = Explode(Curve=wbdual, Recursive=True)  # -> Segments, Vertices
eval = EvaluateCurve(Curve=reparameterize(explode.Segments), Parameter=0.5)  # -> Point, Tangent, Angle
end = EndPoints(Curve=explode.Segments)  # -> Start, End
ln = Line(StartPoint=eval.Point, EndPoint=graft(pcen.CenterV))
duppt = RemoveDuplicatePts(Points=flatten(explode.Vertices), Tolerance=0.01)
end_2 = EndPoints(Curve=ln)  # -> Start, End
ln_2 = Line(StartPoint=eval.Point, EndPoint=end.End)
ln_3 = Line(StartPoint=eval.Point, EndPoint=end.Start)
brep = Brep(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)
crv = Curve(flatten([ln_3, ln_2, ln]))
equalizen = EqualizeN(Lines=ln, EqNStrength=500)
planarize = Planarize(Vertices=eval.Point, Strength=500)
bend = Bend(Point1=end.End, Point2=end_2.Start, Point3=end_2.End, BendStrength=100, RestAngle=1.570796327)
bend_2 = Bend(Point1=end.Start, Point2=end_2.Start, Point3=end_2.End, BendStrength=100, RestAngle=1.570796327)
mesh_2 = MeshBrep(
    Brep=brep,
    Settings={GridMaxCount=0, GridMinCount=16, JaggedSeams=False, MaxEdgeLength=2, MinEdgeLength=1, MinTolerance=0, Refine=True, RefineAngle=0, RelativeTolerance=0.65, SimplePlanes=False, Tolerance=0})
dupln = RemoveDuplicateLines(Lines=crv, Tolerance=0.01)
pulltomesh = PullToMesh(ConstraintMesh=mesh_2, Points=[pcen.CenterV, duppt], PullStrength=100)
kangaroo_settings = KangarooSettings(
    Tolerance=0.001,
    TimeStep=0.01,
    SubIterations=10,
    Floor=False,
    Drag=1,
    Restitution=0.7,
    StaticFriction=10,
    KineticFriction=10,
    Settle=2,
    Tumble=1,
    Sound=False,
    Solver=0)
springs = SpringsFromLine(Connection=dupln, Stiffness=1, Damping=10, RestLength=dupln, UpperCutoff=0, LowerCutoff=0, Plasticity=0)
kangaroo = KangarooPhysics(
    ForceObjects=flatten([springs, planarize, bend, bend_2, equalizen, pulltomesh]),
    Settings=kangaroo_settings,
    Geometry=ln,
    SimulationReset=Button())  # -> Out, Iterations, ParticlesOut, GeometryOut
crv_2 = Curve(kangaroo.GeometryOut)
end_3 = EndPoints(Curve=crv_2)  # -> Start, End
fcircle = CircleFit(Points=end_3.Start)  # -> Circle, Radius, Deviation
