# Grasshopper definition Pendulum_forcedisplay.gh (Grasshopper 0.9.75)
# plug-ins: Kangaroo Components

crv = Curve(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)
kangaroo_settings = KangarooSettings(
    Tolerance=0.001,
    TimeStep=0.01,
    SubIterations=10,
    Floor=False,
    Drag=0,
    Restitution=0.7,
    StaticFriction=10,
    KineticFriction=10,
    Settle=2,
    Tumble=1,
    Sound=False,
    Solver=0)
pt = Point(Point(0, 0, 30))
springs = SpringsFromLine(Connection=crv, Stiffness=1000, Damping=0, RestLength=crv, UpperCutoff=0, LowerCutoff=0, Plasticity=0)
uforce = UnaryForce(Point=Point(0, 0, 30), Force=Vector(0, 0, -9.8))
vec = Vector(pt)
entwine = Entwine(Branch00=crv, Branch01=pt, Branch02=vec)
# no need for a timer or toggle - just double click the kangaroo!
kangaroo = KangarooPhysics(
    ForceObjects=[uforce, springs],
    AnchorPoints=Point(20, 0, 30),
    Settings=kangaroo_settings,
    Geometry=entwine,
    SimulationReset=True)  # -> Out, Iterations, ParticlesOut, GeometryOut
bang = ExplodeTree(Data=kangaroo.GeometryOut)  # -> Branch0, Branch1, Branch2
crv_2 = Curve(bang.Branch0)
vdis = VectorDisplay(Anchor=bang.Branch1, Vector=bang.Branch2)
