# Grasshopper definition Reciprocal_Structure.gh (Grasshopper 0.9.61)
# plug-ins: Kangaroo Components

crv = Curve([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])
crossref = CrossReference(ListA=crv, ListB=crv, CrossMode=5)  # -> ListA, ListB
crv_2 = Curve(crv)
number_slider = Slider(0.513, range=0.01..3)
end = EndPoints(Curve=crossref.ListA)  # -> Start, End
end_2 = EndPoints(Curve=crossref.ListB)  # -> Start, End
end_3 = EndPoints(Curve=crv_2)  # -> Start, End
lineline = LineLine(
    L1Start=end.Start,
    L1End=end.End,
    L2Start=end_2.Start,
    L2End=end_2.End,
    Strength=5000,
    UpperCutoff=100,
    LowerCutoff=0,
    Offset=number_slider,
    Exponent=1)
springs = SpringsFromLine(Connection=crv_2, Stiffness=100, Damping=10, RestLength=crv_2, UpperCutoff=0, LowerCutoff=0, Plasticity=0)
anchorspring = AnchorSpring(Point=[end_3.Start, end_3.End], Strength=10, Sticky=1000)

timer = Timer(TimerInterval=20, Target=kangaroo)  # disabled

kangaroo = KangarooPhysics(ForceObjects=flatten([lineline, anchorspring, springs]), Settings=null, Geometry=crv_2, SimulationReset=Button())  # -> Out, Iterations, ParticlesOut, GeometryOut
multiplication = Multiplication(A=number_slider, B="0.5")
line = Line(kangaroo.GeometryOut)
crossref_2 = CrossReference(ListA=line, ListB=line, CrossMode=5)  # -> ListA, ListB
pipe = Pipe(Curve=line, Radius=multiplication, Caps=0)
llx = LineLine(Line1=crossref_2.ListA, Line2=crossref_2.ListB)  # -> ParamA, ParamB, PointA, PointB
ln = Line(StartPoint=llx.PointA, EndPoint=llx.PointB)
