# Grasshopper definition demo_reciprocal_structures (1).gh (Grasshopper 0.9.75)
# plug-ins: Kangaroo Components, Mesh Pipe

msphere = MeshSphere(Base=PlaneXY(0, 0, 0), Radius=10, UCount=10, VCount=20)
# See:
# 
# http://www.grasshopper3d.com/group/kangaroo/forum/topics/reciprocal-structures-example-definition
# 
# for more information
rm = ReMesh(InitialMesh=msphere, EdgeLength="4", Tolerance=0.1, PullStrength=1, TargetMesh=msphere, Reset=Button())  # -> ReMesh, Iterations

mesh = Mesh(rm.ReMesh)
mesh_2 = Mesh()

reciprocal = Reciprocal(Mesh=mesh_2, Angle=Slider(0.414, range=0..3.141), Scale=Slider(1.7, range=1..2))  # -> Lines, A, B
number_slider = Slider(0.2, range=0..1)
item = ListItem(List=reciprocal.Lines, Index=reciprocal.A, Wrap=True)
item_2 = ListItem(List=reciprocal.Lines, Index=reciprocal.B, Wrap=True)
end = EndPoints(Curve=item_2)  # -> Start, End
end_2 = EndPoints(Curve=item)  # -> Start, End
lineline = LineLine(
    L1Start=end_2.Start,
    L1End=end_2.End,
    L2Start=end.Start,
    L2End=end.End,
    Strength=1000,
    UpperCutoff=1,
    LowerCutoff=0,
    Offset=number_slider,
    Exponent=1)
springs = SpringsFromLine(
    Connection=reciprocal.Lines,
    Stiffness=1000,
    Damping=10,
    RestLength=reciprocal.Lines,
    UpperCutoff=0,
    LowerCutoff=0,
    Plasticity=0)
kangaroo = KangarooPhysics(ForceObjects=flatten([lineline, springs]), Settings=null, Geometry=reciprocal.Lines, SimulationReset=True)  # -> Out, Iterations, ParticlesOut, GeometryOut
item_3 = ListItem(List=kangaroo.GeometryOut, Index=reciprocal.A, Wrap=True)
item_4 = ListItem(List=kangaroo.GeometryOut, Index=reciprocal.B, Wrap=True)
mpipe = MeshPipe(Curve=kangaroo.GeometryOut, Radius=expr("x*0.5", number_slider), Accuracy=0.2, Rotation=0, Segments=16, Caps=0)
llx = LineLine(Line1=item_3, Line2=item_4)  # -> ParamA, ParamB, PointA, PointB
ln = Line(StartPoint=llx.PointA, EndPoint=llx.PointB)
len = Length(Curve=ln)
panel = Panel(len)
