# Grasshopper definition reciprocal_demo.gh (Grasshopper 0.9.61)
# plug-ins: Kangaroo Components

sph = Sphere(Base=PlaneXY(0, 0, 0), Radius=10)
scale_nu = ScaleNU(Geometry=sph, Plane=PlaneXY(0, 0, 0), ScaleX=1, ScaleY=1, ScaleZ=1.5)  # -> Geometry, Transform
mesh = MeshBrep(
    Brep=scale_nu.Geometry,
    Settings={GridMaxCount=0, GridMinCount=16, JaggedSeams=False, MaxEdgeLength=4, MinEdgeLength=4, MinTolerance=0, Refine=True, RefineAngle=0, RelativeTolerance=0.65, SimplePlanes=True, Tolerance=0})
tri = Triangulate(Mesh=mesh)  # -> Mesh, Count
sequence = Sequence(Frames=20)
clean = CombineClean(Meshes=tri.Mesh)
rm = ReMesh(InitialMesh=clean, EdgeLength=4, Tolerance=0.1, PullStrength=1, TargetMesh=clean, Reset=sequence)  # -> ReMesh, Iterations
item = ListItem(List=rm.ReMesh, Index=-1, Wrap=True)
reciprocalstructure = ReciprocalStructure(G=item, D=35, num=4.9, num_2=0.2)  # -> line_2, P, int_3, int_4

# ==== cluster ReciprocalStructure: Turn a mesh into a reciprocal structure and optimize for tangency
G = ClusterInput()
D = ClusterInput()
num = ClusterInput()
scale = Scale(Geometry=G, Center=Point(0, 0, 0), Factor=0.75)  # -> Geometry, Transform
rad = Radians(Degrees=D)
num_2 = ClusterInput()
num_3 = Number(num)
reciprocal = Reciprocal(Mesh=scale.Geometry, Angle=rad, Scale=1.5)  # -> Lines, A, B
num_4 = Number(num_2)
item = ListItem(List=reciprocal.Lines, Index=reciprocal.A, Wrap=True)
item_2 = ListItem(List=reciprocal.Lines, Index=reciprocal.B, Wrap=True)
crv = Curve(reciprocal.Lines)
end = EndPoints(Curve=item)  # -> Start, End
end_2 = EndPoints(Curve=item_2)  # -> Start, End
end_3 = EndPoints(Curve=crv)  # -> Start, End

# ---- group: the new line-line force
lineline = LineLine(
    L1Start=end.Start,
    L1End=end.End,
    L2Start=end_2.Start,
    L2End=end_2.End,
    Strength=5000,
    UpperCutoff=100,
    LowerCutoff=0,
    Offset=num_4,
    Exponent=1)

# ----
springs = SpringsFromLine(Connection=crv, Stiffness=100, Damping=10, RestLength=crv, UpperCutoff=0, LowerCutoff=0, Plasticity=0)
anchorspring = AnchorSpring(Point=[end_3.Start, end_3.End], Strength=0, Sticky=1000)
kangaroo_settings = KangarooSettings(
    Tolerance=0.001,
    TimeStep=0.01,
    SubIterations=500,
    Floor=False,
    Drag=2,
    Restitution=0.7,
    StaticFriction=10,
    KineticFriction=10,
    Settle=2,
    Tumble=1,
    Sound=False,
    Solver=0)
sequence = Sequence(Frames=2)
kangaroo = KangarooPhysics(
    ForceObjects=flatten([lineline, anchorspring, springs]),
    Settings=kangaroo_settings,
    Geometry=crv,
    SimulationReset=sequence)  # -> Out, Iterations, ParticlesOut, GeometryOut
lng = ListLength(List=crv)
split = SplitList(List=kangaroo.GeometryOut, Index=lng)  # -> ListA, ListB
eval = EvaluateCurve(Curve=reparameterize(split.ListB), Parameter=0.5)  # -> Point, Tangent, Angle
len = Length(Curve=split.ListB)
division = Division(A=num_3, B=len)
multiplication = Multiplication(A=num_4, B=0.5)
scale_2 = Scale(Geometry=split.ListB, Center=eval.Point, Factor=division)  # -> Geometry, Transform
line = Line(scale_2.Geometry)
line_2 = ClusterOutput(line)
int = Integer(reciprocal.A)
pipe = Pipe(Curve=line, Radius=multiplication, Caps=0)  # -> flatten(Pipe)
int_2 = Integer(reciprocal.B)
P = ClusterOutput(pipe)
int_3 = ClusterOutput(int)
int_4 = ClusterOutput(int_2)
