# Grasshopper definition StrandbeestMechanism.gh (Grasshopper 0.9.61)
# plug-ins: Kangaroo Components

button = Button()
crv = Curve([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])
# Static anchors
pt = Point([Point(-13.00180219, 0, 20), Point(25, 0, 27.80229184), Point(63, 0, 20)])
pt_2 = Point(Point(10, 0, 27.8))

# ----
# The timer object affects all downstream
# objects, so we do not need to also
# connect it to the Kangaroo component.
timer = Timer(TimerInterval=1, Target=counter)  # disabled
counter = Counter(Reset=button)

anchorxyz = AnchorXYZ(Point=pt, ConstrainX=True, ConstrainY=True, ConstrainZ=True)
springs = SpringsFromLine(Connection=crv, Stiffness=3000, Damping=10, RestLength=crv, UpperCutoff=0, LowerCutoff=0, Plasticity=0)
# The counter increases by 1 each
# iteration, so we need to multiply this to
# get a good speed of rotation.
multiplication = Multiplication(A=counter, B=Slider(0.04, range=0..0.1))
# Moving anchor
rotate = Rotate(Geometry=pt_2, Angle=multiplication, Plane=Plane(origin=(25, 0, 27.80229184), x=(0, 0, 1), y=(1, 0, 0)))  # -> Geometry, Transform
kangaroo = KangarooPhysics(ForceObjects=[anchorxyz, springs], AnchorPoints=rotate.Geometry, Settings=null, Geometry=crv, SimulationReset=button)  # -> Out, Iterations, ParticlesOut, GeometryOut
crv_2 = Curve(kangaroo.GeometryOut)
