# Grasshopper definition Wheel_motor.gh (Grasshopper 0.9.75)
# plug-ins: Kangaroo Components

# This can be any closed solid mesh
slider = Slider(2.1, range=0..10)
mesh = Mesh(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)
# This is a cluster/user object.
# You can double click to look inside
# and see how it works.
wheel = Wheel(plane=PlaneXZ(9, 0, 8), stiffness=1000, depth=3, R=3, S=12, strength=slider)  # -> pt_6, pt_5, line_2, forces_2
collidemesh = CollideMesh(Solid=mesh, Points=wheel.pt_5, Hardness=0.7, Traction=Slider(1, range=0..1))
Z = UnitZ(Factor=-1)
uforce = UnaryForce(Point=wheel.pt_5, Force=Z)

timer = Timer(TimerInterval=20, Target=kangaroo)  # disabled

kangaroo = KangarooPhysics(
    ForceObjects=flatten([wheel.forces_2, uforce, collidemesh]),
    Settings=null,
    Geometry=wheel.line_2,
    SimulationReset=Toggle(True))  # -> Out, Iterations, ParticlesOut, GeometryOut
crv = Curve(kangaroo.GeometryOut)

# ==== cluster Wheel: Create a motorized wheel
plane = ClusterInput()
depth = ClusterInput()
plane_2 = Plane(plane)
depth_2 = Number(depth)
R = ClusterInput()
S = ClusterInput()
pcomp = PlaneComponents(Plane=plane_2)  # -> Origin, XAxis, YAxis, ZAxis
polygon = Polygon(Plane=plane_2, Radius=R, Segments=S, FilletRadius=0)  # -> Polygon, Length
pt = PointXYZ(XComponent=0, YComponent=0, ZComponent=depth_2, System=plane_2)
pt_2 = PointXYZ(XComponent=0, YComponent=0, ZComponent=0, System=plane_2)
multiplication = Multiplication(A=pcomp.ZAxis, B=depth_2)
disc = Discontinuity(Curve=polygon.Polygon, Level=1)  # -> Points, Parameters
explode = Explode(Curve=polygon.Polygon, Recursive=True)  # -> Segments, Vertices
move = Move(Geometry=disc.Points, Motion=multiplication)  # -> Geometry, Transform
shift = ShiftList(List=disc.Points, Shift=1, Wrap=True)
ln = Line(StartPoint=pt_2, EndPoint=pt)
ln_2 = Line(StartPoint=pt, EndPoint=disc.Points)
ln_3 = Line(StartPoint=move.Geometry, EndPoint=disc.Points)
ln_4 = Line(StartPoint=move.Geometry, EndPoint=shift)
ln_5 = Line(StartPoint=pt_2, EndPoint=disc.Points)
ln_6 = Line(StartPoint=pt_2, EndPoint=move.Geometry)
move_2 = Move(Geometry=[explode.Segments, ln_5], Motion=multiplication)  # -> Geometry, Transform
strength = ClusterInput()
crv = Curve([ln, ln_6, ln_2, ln_3, ln_4, move_2.Geometry, explode.Segments, ln_5])
vortex = Vortex(AxisStart=pt_2, AxisEnd=pt, Point=[disc.Points, move.Geometry], Strength=strength, Cutoff=0, Exponent=1)
stiffness = ClusterInput()
springs = SpringsFromLine(
    Connection=flatten(crv),
    Stiffness=stiffness,
    Damping=10,
    RestLength=flatten(crv),
    UpperCutoff=0,
    LowerCutoff=0,
    Plasticity=0)
line = Line(flatten(crv))
pt_3 = Point([disc.Points, move.Geometry])
pt_4 = Point([pt_2, pt])
pt_5 = ClusterOutput(pt_3)
pt_6 = ClusterOutput(pt_4)
line_2 = ClusterOutput(line)
forces = Data(flatten([springs, vortex]))
forces_2 = ClusterOutput(forces)
