# Grasshopper definition 2Dcollision.gh (Grasshopper 0.9.64)
# plug-ins: GearToy

# ---- group: select this and use the gumball to move
pt = Point(Point(-36.3481438, 3.079635254, 0))

# ----
D = Driver(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)
crv = Curve(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)
gears = Gears(Driver=D, Follower=crv, Axle=pt, Pull=False, Reset=Button())  # -> Follower, Compound, Angle
crv_2 = Curve(gears.Follower)
