# Grasshopper definition cams.gh (Grasshopper 0.9.75)
# plug-ins: Kangaroo Components

knob = ControlKnob(Decimals=2, Limit=False, Maximum=10, Minimum=-10, Range=6.28, Value=0)
reset = Button()
P = Plane(PlaneXY(27, 6, 0))
# Note - you need to open the Rhino file with the same name from this folder
crv = Curve(<curve referenced from the Rhino model>)
crv_2 = Curve(<curve referenced from the Rhino model>)
pt = Point(Point(37, 19, 0))
crv_3 = Curve(<curve referenced from the Rhino model>)
pt_2 = Point(Point(26, 26, 0))
crv_4 = Curve(<curve referenced from the Rhino model>)
pt_3 = Point(Point(11, 44, 0))
rotate = Rotate(Geometry=crv, Angle=knob, Plane=P)  # -> Geometry, Transform
toggle = BooleanToggle(True)
gears = Gears(Driver=rotate.Geometry, Follower=crv_2, Axle=pt, Pull=toggle, Reset=reset)  # -> Follower, Compound, Angle
gears_2 = Gears(Driver=gears.Follower, Follower=crv_3, Axle=pt_2, Pull=toggle, Reset=reset)  # -> Follower, Compound, Angle
gears_3 = Gears(Driver=gears_2.Follower, Follower=crv_4, Axle=pt_3, Pull=toggle, Reset=reset)  # -> Follower, Compound, Angle
