# Grasshopper definition compoundgear.gh (Grasshopper 0.9.75)
# plug-ins: Kangaroo Components

# Note - you need to open the Rhino file with the same name from this folder
speed = Slider(0.02, range=-0.1..0.1)
reset = BooleanToggle(False)
timer = Timer(TimerInterval=1, Target=c_script)
c_script = CSharpScript(x=reset, y=speed)  # -> out, A; inputs x: Boolean, y: Double
# ---------- c_script: C# ----------
    if(x){p = 0;}
    else{p += y;}
    A = p;
# ---------- c_script: C# additional code ----------
  double p;
# ---------- end c_script ----------
pt = Point(Point(34.37036782, 51.77737594, 0))
crv = Curve(<curve referenced from the Rhino model>)
pt_2 = Point(Point(17.26860223, 25.0558672, 0))
# use these if you need to re-initialize the axis positions
# (connect them to the points to the right and internalize)
pt_3 = Point(Point(51.43294408, 21.97005568, 0))
rotate = Rotate(Geometry=crv, Angle=c_script.A, Plane=pt)  # -> Geometry, Transform

# ----
# select these and move with the gumball to move the gears
pt_4 = Point(Point(51.43294408, 21.97005568, 0))
pt_5 = Point(Point(17.26860223, 25.0558672, 0))

toggle = BooleanToggle(False)
button = Button()
crv_2 = Curve(<curve referenced from the Rhino model>)
G = Geometry(<curve referenced from the Rhino model>)
gears = Gears(Driver=rotate.Geometry, Follower=crv_2, Axle=pt_5, Compound=G, Pull=toggle, Reset=button)  # -> Follower, Compound, Angle
trim = TrimWithRegion(Curve=gears.Compound, Region=rotate.Geometry)  # -> Inside, Outside
crv_3 = Curve(<curve referenced from the Rhino model>)
crv_4 = Curve(gears.Follower)
crv_5 = Curve(trim.Outside)
G_2 = Geometry(<curve referenced from the Rhino model>)
gears_2 = Gears(Driver=gears.Compound, Follower=crv_3, Axle=pt_4, Compound=G_2, Pull=toggle, Reset=button)  # -> Follower, Compound, Angle
trim_2 = TrimWithRegion(Curve=gears_2.Compound, Region=gears.Compound)  # -> Inside, Outside
crv_6 = Curve(gears_2.Follower)
crv_7 = Curve(trim_2.Outside)
