# Grasshopper definition epicyclic.gh (Grasshopper 0.9.75)
# plug-ins: Kangaroo Components

number_slider = Slider(0, range=0..1)
reset = Button()

# ----
# Note - you need to open the Rhino file with the same name from this folder
crv = Curve(<curve referenced from the Rhino model>)
crv_2 = Curve(<curve referenced from the Rhino model>)
pt = Point(Point(34.37036782, 75.57541018, 0))
pt_2 = Point(Point(13.7606656, 39.87835882, 0))
crv_3 = Curve(<curve referenced from the Rhino model>)
pt_3 = Point(Point(54.98007003, 39.87835882, 0))
crv_4 = Curve(<curve referenced from the Rhino model>)
P = Plane(PlaneXY(34.37036782, 51.77737594, 0))
rotate = Rotate(Geometry=pt_3, Angle=number_slider, Plane=P)  # -> Geometry, Transform
rotate_2 = Rotate(Geometry=pt, Angle=number_slider, Plane=P)  # -> Geometry, Transform
rotate_3 = Rotate(Geometry=pt_2, Angle=number_slider, Plane=P)  # -> Geometry, Transform
gears = Gears(Driver=crv, Follower=crv_2, Axle=rotate_2.Geometry, Pull=False, Reset=reset)  # -> Follower, Compound, Angle
gears_2 = Gears(Driver=crv, Follower=crv_4, Axle=rotate_3.Geometry, Pull=False, Reset=reset)  # -> Follower, Compound, Angle
gears_3 = Gears(Driver=crv, Follower=crv_3, Axle=rotate.Geometry, Pull=False, Reset=reset)  # -> Follower, Compound, Angle
pt_4 = Point(<point referenced from the Rhino model>)
crv_5 = Curve(<curve referenced from the Rhino model>)
crv_6 = Curve([gears.Follower, gears_2.Follower, gears_3.Follower])
gears_4 = Gears(Driver=crv_6, Follower=crv_5, Axle=pt_4, Pull=False, Reset=reset)  # -> Follower, Compound, Angle
crv_7 = Curve(gears_4.Follower)
