# Grasshopper definition geneva.gh (Grasshopper 0.9.75)
# plug-ins: Kangaroo Components

button = Button()
# Note - you need to open the Rhino file with the same name from this folder
timer = Timer(TimerInterval=1, Target=c_script)  # disabled
c_script = CSharpScript(x=button, y=Slider(0.039, range=-0.05..0.05))  # -> out, A; inputs x: Boolean, y: Double
# ---------- c_script: C# ----------
    if(x){p = 0;}
    else{p += y;}
    A = p;
# ---------- c_script: C# additional code ----------
  double p;
# ---------- end c_script ----------
pt = Point(Point(16.59118261, 14.70259464, 0))
crv = Curve([<curve referenced from the Rhino model> x2])
rotate = Rotate(Geometry=crv, Angle=c_script.A, Plane=pt)  # -> Geometry, Transform
pt_2 = Point(Point(33.05976994, 14.70259464, 0))
crv_2 = Curve(<curve referenced from the Rhino model>)
gears = Gears(Driver=rotate.Geometry, Follower=crv_2, Axle=pt_2, Pull=False, Reset=button)  # -> Follower, Compound, Angle
