# Grasshopper definition rackandpinion.gh (Grasshopper 0.9.75)
# plug-ins: Kangaroo Components

crv = Curve(<curve referenced from the Rhino model>)
pt = Point(<point referenced from the Rhino model>)
reset = Button()
# Note - you need to open the Rhino file with the same name from this folder
crv_2 = Curve(<curve referenced from the Rhino model>)
X = UnitX(Factor=Slider(0, range=0..45))
move = Move(Geometry=crv_2, Motion=X)  # -> Geometry, Transform
gears = Gears(Driver=move.Geometry, Follower=crv, Axle=pt, Pull=False, Reset=reset)  # -> Follower, Compound, Angle
