# Grasshopper definition New_mesh_tools.gh (Grasshopper 0.9.61)
# plug-ins: Kangaroo Components

mesh = Mesh(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)
mesh_2 = Mesh([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])
byparent = ByParent(Mesh=mesh, Level=3)
move = Move(Geometry=mesh, Motion=Vector(0, -58, 0))  # -> Geometry, Transform
diag = Diagonalize(Mesh=mesh_2)
clean = CombineClean(Meshes=byparent)
move_2 = Move(Geometry=diag, Motion=Vector(0, 23, 0))  # -> Geometry, Transform
springsfrommesh = SpringsFromMesh(M=clean, stiffness=1000, B=0)
nv = NakedVertices(Mesh=clean)  # -> ClothedIndex, NakedIndex, ClothedPts, NakedPts
medges = MeshEdges(Mesh=[move_2.Geometry, mesh_2])  # -> NakedEdges, InteriorEdges, NonManifoldEdges
kangaroo_settings = KangarooSettings(
    Tolerance=0.001,
    TimeStep=0.01,
    SubIterations=60,
    Floor=False,
    Drag=5,
    Restitution=0.7,
    StaticFriction=10,
    KineticFriction=10,
    Settle=2,
    Tumble=1,
    Sound=False,
    Solver=0)
sequence = Sequence(Frames=2)
kangaroo = KangarooPhysics(
    ForceObjects=springsfrommesh,
    AnchorPoints=nv.NakedPts,
    Settings=kangaroo_settings,
    Geometry=byparent,
    SimulationReset=sequence)  # -> Out, Iterations, ParticlesOut, GeometryOut
lng = ListLength(List=byparent)
number_slider = Slider(0.133, range=0..1)  # disabled
number_slider_2 = Slider(0.11, range=0..1)  # disabled
mesh_3 = Mesh(kangaroo.GeometryOut)
split = SplitList(List=mesh_3, Index=lng)  # -> ListA, ListB
random = Random(Range=Domain(0, 1), Number=lng, Seed=2)
mesh_4 = Mesh(split.ListB)
clean_2 = CombineClean(Meshes=mesh_4)
md = MeshDirection(Mesh=clean_2)
turn = MeshTurn(Mesh=md)
move_3 = Move(Geometry=turn, Motion=Vector(-33, 0, 0))  # -> Geometry, Transform
strips = RefineStrips(Mesh=md, Level=2)
mesh_5 = Mesh(md)  # disabled
warpweft = WarpWeft(Mesh=clean_2)  # -> Warp, Weft, NakedA, NakedB
strips_2 = RefineStrips(Mesh=move_3.Geometry, Level=2)
stripper = Stripper(Mesh=strips)
weaving = Weaving(mesh=mesh_5, num_2=number_slider, num=number_slider_2)  # -> mesh_10, mesh_9; disabled
move_4 = Move(Geometry=warpweft.Warp, Motion=Vector(42, 0, 0))  # -> Geometry, Transform
move_5 = Move(Geometry=warpweft.Weft, Motion=Vector(85, 0, 0))  # -> Geometry, Transform
gradient = Gradient(
    LowerLimit=0,
    UpperLimit=1,
    Parameter=random,
    stops=[0: RGB(243, 57, 0), 0.1: RGB(236, 27, 60), 0.2: RGB(210, 0, 118), 0.3: RGB(103, 0, 120), 0.4: RGB(39, 72, 161), 0.5: RGB(1, 192, 229), 0.6: RGB(18, 178, 90), 0.7: RGB(79, 186, 8), 0.8: RGB(220, 237, 32), 0.9: RGB(247, 159, 20), 1: RGB(243, 57, 0)])
stripper_2 = Stripper(Mesh=strips_2)
move_6 = Move(Geometry=stripper, Motion=Vector(0, 55, 0))  # -> Geometry, Transform
preview = CustomPreview(
    Geometry=weaving.mesh_10,
    Shader={ambient=RGB(128, 128, 128), diffuse=RGB(0, 0, 255), emission=RGB(0, 0, 0), shine=0, specular=RGB(105, 105, 105), transparency=0})  # disabled
preview_2 = CustomPreview(
    Geometry=weaving.mesh_9,
    Shader={ambient=RGB(128, 128, 128), diffuse=RGB(255, 0, 0), emission=RGB(0, 0, 0), shine=0, specular=RGB(0, 0, 0), transparency=0})  # disabled
move_7 = Move(Geometry=mesh_4, Motion=Vector(-34, 0, 0))  # -> Geometry, Transform
lng_2 = ListLength(List=move_6.Geometry)
move_8 = Move(Geometry=stripper_2, Motion=Vector(0, 55, 0))  # -> Geometry, Transform
mesh_6 = Mesh(weaving.mesh_9)  # disabled
random_2 = Random(Range=Domain(0, 1), Number=lng_2, Seed=2)
preview_3 = CustomPreview(Geometry=move_7.Geometry, Shader=gradient)
lng_3 = ListLength(List=move_8.Geometry)
gradient_2 = Gradient(
    LowerLimit=0,
    UpperLimit=1,
    Parameter=random_2,
    stops=[0: RGB(243, 57, 0), 0.1: RGB(236, 27, 60), 0.2: RGB(210, 0, 118), 0.3: RGB(103, 0, 120), 0.4: RGB(39, 72, 161), 0.5: RGB(1, 192, 229), 0.6: RGB(18, 178, 90), 0.7: RGB(79, 186, 8), 0.8: RGB(220, 237, 32), 0.9: RGB(247, 159, 20), 1: RGB(243, 57, 0)])
random_3 = Random(Range=Domain(0, 1), Number=lng_3, Seed=2)
gradient_3 = Gradient(
    LowerLimit=0,
    UpperLimit=1,
    Parameter=random_3,
    stops=[0: RGB(243, 57, 0), 0.1: RGB(236, 27, 60), 0.2: RGB(210, 0, 118), 0.3: RGB(103, 0, 120), 0.4: RGB(39, 72, 161), 0.5: RGB(1, 192, 229), 0.6: RGB(18, 178, 90), 0.7: RGB(79, 186, 8), 0.8: RGB(220, 237, 32), 0.9: RGB(247, 159, 20), 1: RGB(243, 57, 0)])
material = CreateMaterial(Diffuse=gradient_2, Specular=RGB(255, 255, 255), Emission=gradient_2, Transparency=0, Shine=0)
material_2 = CreateMaterial(Diffuse=gradient_3, Specular=RGB(255, 255, 255), Emission=gradient_3, Transparency=0, Shine=0)
preview_4 = CustomPreview(Geometry=move_6.Geometry, Shader=material)
preview_5 = CustomPreview(Geometry=move_8.Geometry, Shader=material_2)

# ==== cluster SpringsFromMesh: Turns all edges of a mesh into springs
M = ClusterInput()
medges = MeshEdges(Mesh=M)  # -> NakedEdges, InteriorEdges, NonManifoldEdges
crv = Curve([medges.NakedEdges, medges.InteriorEdges])
B = ClusterInput()
len = Length(Curve=crv)
multiplication = Multiplication(A=len, B=B)
stiffness = ClusterInput()
springs = SpringsFromLine(Connection=crv, Stiffness=stiffness, Damping=10, RestLength=multiplication, UpperCutoff=0, LowerCutoff=0, Plasticity=0)
S = ClusterOutput(springs)

# ==== cluster Weaving
mesh = ClusterInput()
mesh_2 = Mesh(mesh)
checkerboard = Checkerboard(Mesh=mesh_2)
facen = FaceNormals(Mesh=mesh_2)  # -> Centers, Normals
faceb = FaceBoundaries(Mesh=mesh_2)
num = ClusterInput()
num_2 = ClusterInput()
num_3 = Number(num)
dispatch = Dispatch(List=faceb, DispatchPattern=checkerboard)  # -> ListA, ListB
num_4 = Number(num_2)
dispatch_2 = Dispatch(List=facen.Normals, DispatchPattern=checkerboard)  # -> ListA, ListB

crv = Curve(dispatch.ListB)
explode = Explode(Curve=crv, Recursive=True)  # -> reparameterize(Segments), Vertices
item = ListItem(List=explode.Segments, Index=2, Wrap=True)
item_2 = ListItem(List=explode.Segments, Index=0, Wrap=True)
neg = Negative(Value=num_3)
item_3 = ListItem(List=explode.Segments, Index=3, Wrap=True)
item_4 = ListItem(List=explode.Segments, Index=1, Wrap=True)
subtraction = Subtraction(A=1, B=num_4)
subtraction_2 = Subtraction(A=1, B=num_4)
eval = EvaluateCurve(Curve=item_2, Parameter=subtraction)  # -> Point, Tangent, Angle
eval_2 = EvaluateCurve(Curve=item, Parameter=subtraction)  # -> Point, Tangent, Angle
eval_3 = EvaluateCurve(Curve=item_2, Parameter=num_4)  # -> Point, Tangent, Angle
eval_4 = EvaluateCurve(Curve=item, Parameter=num_4)  # -> Point, Tangent, Angle
eval_5 = EvaluateCurve(Curve=item_4, Parameter=subtraction_2)  # -> Point, Tangent, Angle
eval_6 = EvaluateCurve(Curve=item_3, Parameter=subtraction_2)  # -> Point, Tangent, Angle
eval_7 = EvaluateCurve(Curve=item_4, Parameter=num_4)  # -> Point, Tangent, Angle
eval_8 = EvaluateCurve(Curve=item_3, Parameter=num_4)  # -> Point, Tangent, Angle
multiplication = Multiplication(A=neg, B=dispatch_2.ListB)
multiplication_2 = Multiplication(A=num_3, B=dispatch_2.ListB)
avr = Average(Input=[eval_3.Point, eval_2.Point])
avr_2 = Average(Input=[eval.Point, eval_4.Point])
avr_3 = Average(Input=[eval_7.Point, eval_6.Point])
avr_4 = Average(Input=[eval_5.Point, eval_8.Point])
move = Move(Geometry=avr_2, Motion=graft(multiplication))  # -> Geometry, Transform
move_2 = Move(Geometry=avr, Motion=graft(multiplication))  # -> Geometry, Transform
move_3 = Move(Geometry=avr_4, Motion=graft(multiplication_2))  # -> Geometry, Transform
move_4 = Move(Geometry=avr_3, Motion=graft(multiplication_2))  # -> Geometry, Transform
merge = Merge(Data1=move_2.Geometry, Data2=move.Geometry, Data3=eval_4.Point, Data4=eval_2.Point)
merge_2 = Merge(Data1=move_4.Geometry, Data2=move_3.Geometry, Data3=eval_8.Point, Data4=eval_6.Point)
merge_3 = Merge(Data1=eval_3.Point, Data2=eval.Point, Data3=move.Geometry, Data4=move_2.Geometry)
merge_4 = Merge(Data1=eval_7.Point, Data2=eval_5.Point, Data3=move_3.Geometry, Data4=move_4.Geometry)
conmesh = ConstructMesh(Vertices=merge_3, Faces={A=0, B=1, C=2, D=3})
conmesh_2 = ConstructMesh(Vertices=merge_4, Faces={A=0, B=1, C=2, D=3})
conmesh_3 = ConstructMesh(Vertices=merge, Faces={A=0, B=1, C=2, D=3})
conmesh_4 = ConstructMesh(Vertices=merge_2, Faces={A=0, B=1, C=2, D=3})

crv_2 = Curve(dispatch.ListA)
explode_2 = Explode(Curve=crv_2, Recursive=True)  # -> reparameterize(Segments), Vertices
item_5 = ListItem(List=explode_2.Segments, Index=2, Wrap=True)
item_6 = ListItem(List=explode_2.Segments, Index=0, Wrap=True)
item_7 = ListItem(List=explode_2.Segments, Index=3, Wrap=True)
item_8 = ListItem(List=explode_2.Segments, Index=1, Wrap=True)
subtraction_3 = Subtraction(A=1, B=num_4)
subtraction_4 = Subtraction(A=1, B=num_4)
neg_2 = Negative(Value=num_3)
eval_9 = EvaluateCurve(Curve=item_6, Parameter=subtraction_3)  # -> Point, Tangent, Angle
eval_10 = EvaluateCurve(Curve=item_5, Parameter=subtraction_3)  # -> Point, Tangent, Angle
eval_11 = EvaluateCurve(Curve=item_6, Parameter=num_4)  # -> Point, Tangent, Angle
eval_12 = EvaluateCurve(Curve=item_5, Parameter=num_4)  # -> Point, Tangent, Angle
eval_13 = EvaluateCurve(Curve=item_8, Parameter=subtraction_4)  # -> Point, Tangent, Angle
eval_14 = EvaluateCurve(Curve=item_7, Parameter=subtraction_4)  # -> Point, Tangent, Angle
eval_15 = EvaluateCurve(Curve=item_8, Parameter=num_4)  # -> Point, Tangent, Angle
eval_16 = EvaluateCurve(Curve=item_7, Parameter=num_4)  # -> Point, Tangent, Angle
multiplication_3 = Multiplication(A=num_3, B=dispatch_2.ListA)
multiplication_4 = Multiplication(A=neg_2, B=dispatch_2.ListA)
avr_5 = Average(Input=[eval_11.Point, eval_10.Point])
avr_6 = Average(Input=[eval_9.Point, eval_12.Point])
avr_7 = Average(Input=[eval_15.Point, eval_14.Point])
avr_8 = Average(Input=[eval_13.Point, eval_16.Point])
move_5 = Move(Geometry=avr_6, Motion=graft(multiplication_3))  # -> Geometry, Transform
move_6 = Move(Geometry=avr_5, Motion=graft(multiplication_3))  # -> Geometry, Transform
move_7 = Move(Geometry=avr_8, Motion=graft(multiplication_4))  # -> Geometry, Transform
move_8 = Move(Geometry=avr_7, Motion=graft(multiplication_4))  # -> Geometry, Transform
merge_5 = Merge(Data1=move_6.Geometry, Data2=move_5.Geometry, Data3=eval_12.Point, Data4=eval_10.Point)
merge_6 = Merge(Data1=move_8.Geometry, Data2=move_7.Geometry, Data3=eval_16.Point, Data4=eval_14.Point)
merge_7 = Merge(Data1=eval_11.Point, Data2=eval_9.Point, Data3=move_5.Geometry, Data4=move_6.Geometry)
merge_8 = Merge(Data1=eval_15.Point, Data2=eval_13.Point, Data3=move_7.Geometry, Data4=move_8.Geometry)
conmesh_5 = ConstructMesh(Vertices=merge_7, Faces={A=0, B=1, C=2, D=3})
conmesh_6 = ConstructMesh(Vertices=merge_8, Faces={A=0, B=1, C=2, D=3})
conmesh_7 = ConstructMesh(Vertices=merge_5, Faces={A=0, B=1, C=2, D=3})
conmesh_8 = ConstructMesh(Vertices=merge_6, Faces={A=0, B=1, C=2, D=3})

mesh_3 = Mesh([conmesh_6, conmesh_8])
mesh_4 = Mesh([conmesh_2, conmesh_4])
mesh_5 = Mesh([conmesh_7, conmesh_5])
mesh_6 = Mesh([conmesh, conmesh_3])
mesh_7 = Mesh([mesh_3, mesh_4])
mesh_8 = Mesh([mesh_5, mesh_6])
mesh_9 = ClusterOutput(mesh_7)
mesh_10 = ClusterOutput(mesh_8)
