# Grasshopper definition warpweft1.gh (Grasshopper 0.9.61)
# plug-ins: Kangaroo Components

mesh = Mesh(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)
refine = Refine(Mesh=mesh, Level=3)

# ---- group: split into warp/weft directions
warpweft = WarpWeft(Mesh=refine)  # -> Warp, Weft, NakedA, NakedB

# ----
stiffness = Stiffness(50)
stiffness_2 = Stiffness(100)
nv = NakedVertices(Mesh=refine)  # -> ClothedIndex, NakedIndex, ClothedPts, NakedPts
springs = SpringsFromLine(Connection=warpweft.Warp, Stiffness=stiffness, Damping=10, RestLength=0, UpperCutoff=0, LowerCutoff=0, Plasticity=0)
springs_2 = SpringsFromLine(Connection=warpweft.Weft, Stiffness=stiffness_2, Damping=10, RestLength=0, UpperCutoff=0, LowerCutoff=0, Plasticity=0)
timer = Timer(TimerInterval=20, Target=kangaroo)  # disabled
kangaroo = KangarooPhysics(
    ForceObjects=flatten([springs, springs_2]),
    AnchorPoints=nv.NakedPts,
    Settings=null,
    Geometry=refine,
    SimulationReset=Button())  # -> Out, Iterations, ParticlesOut, GeometryOut
mesh_2 = Mesh(kangaroo.GeometryOut)
