# Grasshopper definition curved_tensegrity.gh (Grasshopper 0.9.75)
# plug-ins: Kangaroo Components

# ---- group: cables
crv = Curve(graft([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]))

# ---- group: curved bows
crv_2 = Curve(graft([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]))

# ----
divide = DivideCurve(Curve=crv, Count=10, Kinks=False)  # -> Points, Tangents, Parameters
divide_2 = DivideCurve(Curve=crv_2, Count=20, Kinks=False)  # -> Points, Tangents, Parameters
shatter = Shatter(Curve=crv, Parameters=divide.Parameters)
shatter_2 = Shatter(Curve=crv_2, Parameters=divide_2.Parameters)
join = JoinCurves(Curves=shatter_2, Preserve=False)
springs = SpringsFromLine(Connection=shatter, Stiffness=20, Damping=10, RestLength=0, UpperCutoff=0, LowerCutoff=0, Plasticity=0)
line = Line(shatter)
polylinebend = PolyLineBend(polyline=join, bendstrength=1000, B=0)  # -> L, B_2
springs_2 = SpringsFromLine(
    Connection=polylinebend.L,
    Stiffness=1000,
    Damping=10,
    RestLength=polylinebend.L,
    UpperCutoff=0,
    LowerCutoff=0,
    Plasticity=0)
entwine = Entwine(Branch00=polylinebend.L, Branch01=line)
kangaroo = KangarooPhysics(ForceObjects=flatten([springs_2, polylinebend.B_2, springs]), Settings=null, Geometry=entwine, SimulationReset=Button())  # -> Out, Iterations, ParticlesOut, GeometryOut
timer = Timer(TimerInterval=20, Target=kangaroo)  # disabled
bang = ExplodeTree(Data=kangaroo.GeometryOut)  # -> Branch0, Branch1
pipe = Pipe(Curve=bang.Branch0, Radius=0.5, Caps=0)
crv_3 = Curve(bang.Branch1)

# ==== cluster PolyLineBend: PolyLineBend
polyline = ClusterInput()
polyline_2 = Curve(polyline)
cls = Closed(Curve=polyline_2)  # -> Closed, Periodic
explode = Explode(Curve=polyline_2, Recursive=True)  # -> Segments, Vertices
split = SplitList(List=explode.Vertices, Index=1)  # -> ListA, ListB
shift = ShiftList(List=explode.Vertices, Shift=0, Wrap=False)
shift_2 = ShiftList(List=explode.Vertices, Shift=1, Wrap=False)
shift_3 = ShiftList(List=explode.Vertices, Shift=2, Wrap=False)
shift_4 = ShiftList(List=split.ListB, Shift=0, Wrap=True)
shift_5 = ShiftList(List=split.ListB, Shift=1, Wrap=True)
shift_6 = ShiftList(List=split.ListB, Shift=2, Wrap=True)
filter = StreamFilter(Gate=cls.Closed, Stream0=shift_3, Stream1=shift_6)
filter_2 = StreamFilter(Gate=cls.Closed, Stream0=shift_2, Stream1=shift_5)
filter_3 = StreamFilter(Gate=cls.Closed, Stream0=shift, Stream1=shift_4)
short = ShortList(ListA=filter_3, ListB=filter_2, TrimMode=2)  # -> ListA, ListB
short_2 = ShortList(ListA=filter_3, ListB=filter_2, ListC=filter, TrimMode=2)  # -> ListA, ListB, ListC
ln = Line(StartPoint=short.ListA, EndPoint=short.ListB)
L = ClusterOutput(ln)
vec2pt = Vector2Pt(PointA=short_2.ListA, PointB=short_2.ListB, Unitize=False)  # -> Vector, Length
vec2pt_2 = Vector2Pt(PointA=short_2.ListB, PointB=short_2.ListC, Unitize=False)  # -> Vector, Length
angle = Angle(VectorA=vec2pt.Vector, VectorB=vec2pt_2.Vector)  # -> Angle, Reflex
B = ClusterInput()
multiplication = Multiplication(A=angle.Angle, B=B)
bendstrength = ClusterInput()
bend = Bend(Point1=short_2.ListA, Point2=short_2.ListB, Point3=short_2.ListC, BendStrength=bendstrength, RestAngle=multiplication)
B_2 = ClusterOutput(bend)
