# Grasshopper definition Periodic_catenaries.gh (Grasshopper 0.9.75)
# plug-ins: Kangaroo Components

crv = Curve(graft([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]))
pt = Point(Point(50, 20, 0))
pt_2 = Point(Point(30, 20, 0))
vec2pt = Vector2Pt(PointA=pt_2, PointB=pt, Unitize=False)  # -> Vector, Length
divide = DivideCurve(Curve=crv, Count=crv, Kinks=False)  # -> Points, Tangents, Parameters
translock = TranslationLock(Point1=pt_2, Point2=pt)
shatter = Shatter(Curve=crv, Parameters=divide.Parameters)
Y = UnitY(Factor=1)
end = EndPoints(Curve=shatter)  # -> Start, End
springs = SpringsFromLine(Connection=shatter, Stiffness=1000, Damping=10, RestLength=shatter, UpperCutoff=0, LowerCutoff=0, Plasticity=0)
uforce = UnaryForce(Point=[end.Start, end.End], Force=Y)
pt_3 = Point([Point(30, 10, 0), Point(50, 10, 0)])
kangaroo = KangarooPhysics(
    ForceObjects=flatten([springs, uforce, translock]),
    AnchorPoints=pt_3,
    Settings=null,
    Geometry=shatter,
    SimulationReset=True)  # -> Out, Iterations, ParticlesOut, GeometryOut
series = Series(Start=0, Step=1, Count=10)
multiplication = Multiplication(A=vec2pt.Vector, B=series)
crv_2 = Curve(kangaroo.GeometryOut)
move = Move(Geometry=graft(crv_2), Motion=multiplication)  # -> Geometry, Transform
