# Grasshopper definition StandingWave.gh (Grasshopper 0.9.75)
# plug-ins: Kangaroo Components

panel = Panel("https://vimeo.com/12075151")
X = UnitX(Factor=1)

toggle = BooleanToggle(True)
timer = Timer(TimerInterval=1, Target=counter)  # disabled

line = LineSDL(Start=Point(0, 0, 0), Direction=X, Length=20)
Y = UnitY(Factor=Slider(0.263, range=0..1))
move = Move(Geometry=line, Motion=Y)  # -> Geometry, Transform
counter = Counter(Reset=toggle)
divide = DivideCurve(Curve=move.Geometry, Count=40, Kinks=False)  # -> Points, Tangents, Parameters
end = EndPoints(Curve=move.Geometry)  # -> Start, End
shatter = Shatter(Curve=move.Geometry, Parameters=divide.Parameters)
multiplication = Multiplication(A=counter, B=Slider(0.162, range=0..1))
yz = YZPlane(Origin=Point(0, 0, 0))
rotate = Rotate(Geometry=[end.Start, end.End], Angle=multiplication, Plane=yz)  # -> Geometry, Transform
kangaroo_settings = KangarooSettings(
    Tolerance=0.001,
    TimeStep=0.01,
    SubIterations=10,
    Floor=False,
    Drag=0.05,
    Restitution=0.7,
    StaticFriction=10,
    KineticFriction=10,
    Settle=2,
    Tumble=1,
    Sound=False,
    Solver=0)
springs = SpringsFromLine(Connection=shatter, Stiffness=1000, Damping=10, RestLength=shatter, UpperCutoff=0, LowerCutoff=0, Plasticity=0)
line_2 = Line(shatter)
kangaroo = KangarooPhysics(ForceObjects=springs, AnchorPoints=rotate.Geometry, Settings=kangaroo_settings, Geometry=line_2, SimulationReset=toggle)  # -> Out, Iterations, ParticlesOut, GeometryOut
crv = Curve(kangaroo.GeometryOut)
