# Grasshopper definition constantslope.gh (Grasshopper 0.9.75)
# plug-ins: Kangaroo Components

crv = Curve(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)
P = Point(Point(6, 9.947118756, -1.315673995))
srf = Surface(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)
end = EndPoints(Curve=crv)  # -> Start, End
# Finding a path between 2 points on a landscape with approximately constant slope along its length.
# This is achieved by fixing the Z-spacing of the points and the lengths of the segments, while pulling them to the surface.
number_slider = Slider(1.404, range=0.7..4)
divide = DivideCurve(Curve=crv, Count=60, Kinks=False)  # -> Points, Tangents, Parameters
contour = Contour(Shape=srf, Point=P, Direction=Vector(0, 0, 1), Distance=0.5)
mesh = MeshBrep(
    Brep=srf,
    Settings={GridMaxCount=0, GridMinCount=16, JaggedSeams=False, MaxEdgeLength=0, MinEdgeLength=0.0001, MinTolerance=0, Refine=True, RefineAngle=0, RelativeTolerance=0.65, SimplePlanes=True, Tolerance=0})
shatter = Shatter(Curve=crv, Parameters=divide.Parameters)

# ---- group: constrain z only
anchorxyz = AnchorXYZ(Point=divide.Points, ConstrainX=False, ConstrainY=False, ConstrainZ=True)

# ----
pulltomesh = PullToMesh(ConstraintMesh=mesh, Points=divide.Points, PullStrength=100)
len = Length(Curve=shatter)
join = JoinCurves(Curves=shatter, Preserve=False)
multiplication = Multiplication(A=len, B=number_slider)
polylinebend = PolyLineBend(polyline=join, bendstrength=1, B=0)  # -> L, B_2
springs = SpringsFromLine(Connection=shatter, Stiffness=100, Damping=10, RestLength=multiplication, UpperCutoff=0, LowerCutoff=0, Plasticity=0)
timer = Timer(TimerInterval=20, Target=kangaroo)  # disabled
kangaroo_settings = KangarooSettings(
    Tolerance=0.001,
    TimeStep=0.01,
    SubIterations=20,
    Floor=False,
    Drag=2,
    Restitution=0.7,
    StaticFriction=10,
    KineticFriction=10,
    Settle=2,
    Tumble=1,
    Sound=False,
    Solver=0)
kangaroo = KangarooPhysics(
    ForceObjects=flatten([springs, anchorxyz, pulltomesh, polylinebend.B_2]),
    AnchorPoints=[end.Start, end.End],
    Settings=kangaroo_settings,
    SimulationReset=Button())  # -> Out, Iterations, ParticlesOut, GeometryOut
pline = PolyLine(Vertices=kangaroo.ParticlesOut, Closed=False)
explode = Explode(Curve=pline, Recursive=True)  # -> Segments, Vertices
Z = UnitZ(Factor=1)
angle = Angle(VectorA=Z, VectorB=explode.Segments)  # -> Angle, Reflex
panel = Panel(angle.Angle)

# ==== cluster PolyLineBend: PolyLineBend
polyline = ClusterInput()
polyline_2 = Curve(polyline)
cls = Closed(Curve=polyline_2)  # -> Closed, Periodic
explode = Explode(Curve=polyline_2, Recursive=True)  # -> Segments, Vertices
split = SplitList(List=explode.Vertices, Index=1)  # -> ListA, ListB
shift = ShiftList(List=explode.Vertices, Shift=0, Wrap=False)
shift_2 = ShiftList(List=explode.Vertices, Shift=1, Wrap=False)
shift_3 = ShiftList(List=explode.Vertices, Shift=2, Wrap=False)
shift_4 = ShiftList(List=split.ListB, Shift=0, Wrap=True)
shift_5 = ShiftList(List=split.ListB, Shift=1, Wrap=True)
shift_6 = ShiftList(List=split.ListB, Shift=2, Wrap=True)
filter = StreamFilter(Gate=cls.Closed, Stream0=shift_3, Stream1=shift_6)
filter_2 = StreamFilter(Gate=cls.Closed, Stream0=shift_2, Stream1=shift_5)
filter_3 = StreamFilter(Gate=cls.Closed, Stream0=shift, Stream1=shift_4)
short = ShortList(ListA=filter_3, ListB=filter_2, TrimMode=2)  # -> ListA, ListB
short_2 = ShortList(ListA=filter_3, ListB=filter_2, ListC=filter, TrimMode=2)  # -> ListA, ListB, ListC
ln = Line(StartPoint=short.ListA, EndPoint=short.ListB)
L = ClusterOutput(ln)
vec2pt = Vector2Pt(PointA=short_2.ListA, PointB=short_2.ListB, Unitize=False)  # -> Vector, Length
vec2pt_2 = Vector2Pt(PointA=short_2.ListB, PointB=short_2.ListC, Unitize=False)  # -> Vector, Length
angle = Angle(VectorA=vec2pt.Vector, VectorB=vec2pt_2.Vector)  # -> Angle, Reflex
B = ClusterInput()
multiplication = Multiplication(A=angle.Angle, B=B)
bendstrength = ClusterInput()
bend = Bend(Point1=short_2.ListA, Point2=short_2.ListB, Point3=short_2.ListC, BendStrength=bendstrength, RestAngle=multiplication)
B_2 = ClusterOutput(bend)
