# Grasshopper definition constraintdemo.gh (Grasshopper 0.9.75)
# plug-ins: Kangaroo Components

timer = Timer(TimerInterval=20, Target=kangaroo)  # disabled

perpendicular = BooleanToggle(False)
horizontal = BooleanToggle(False)
# demonstration of geometric constraint satisfaction. Start the simulation and timer, then turn on the constraints one-by-one and observe the results
parallel1 = BooleanToggle(False)
parallel2 = BooleanToggle(False)
lengths = BooleanToggle(False)
crv = Curve(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)
crv_2 = Curve(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)
crv_3 = Curve(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)
crv_4 = Curve(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)
multiplication = Multiplication(A=parallel1, B=100)
multiplication_2 = Multiplication(A=parallel2, B=100)
multiplication_3 = Multiplication(A=horizontal, B=100)
multiplication_4 = Multiplication(A=perpendicular, B=100)
multiplication_5 = Multiplication(A=lengths, B=30)
end = EndPoints(Curve=crv)  # -> Start, End
pt = Point(Point(0, 0, 0))
pt_2 = Point(Point(1, 0, 0))
end_2 = EndPoints(Curve=crv_3)  # -> Start, End
pt_3 = Point([pt, pt_2])
springs = SpringsFromLine(
    Connection=[crv, crv_2, crv_3, crv_4],
    Stiffness=multiplication_5,
    Damping=10,
    RestLength="25",
    UpperCutoff=0,
    LowerCutoff=0,
    Plasticity=0)
end_3 = EndPoints(Curve=crv_2)  # -> Start, End
end_4 = EndPoints(Curve=crv_4)  # -> Start, End
crv_5 = Curve([crv_4, crv_3, crv_2, crv])
particle = Particle(Point=pt_3, Mass=1, Velocity=Vector(0, 0, 0))
anchorxyz = AnchorXYZ(Point=pt_3, ConstrainX=True, ConstrainY=True, ConstrainZ=True)
align = Align(
    Align1=end.Start,
    Align2=end.End,
    Align3=pt,
    Align4=pt_2,
    AlignStrength=multiplication_3,
    Exponent=0,
    Cutoff=100,
    AngleRange=0)
bend = Bend(Point1=end.Start, Point2=end_2.Start, Point3=end_2.End, BendStrength=multiplication_4, RestAngle=1.570796327)
align_2 = Align(
    Align1=end.Start,
    Align2=end.End,
    Align3=end_2.Start,
    Align4=end_2.End,
    AlignStrength=multiplication,
    Exponent=0,
    Cutoff=100,
    AngleRange=0)
align_3 = Align(
    Align1=end_3.Start,
    Align2=end_3.End,
    Align3=end_4.Start,
    Align4=end_4.End,
    AlignStrength=multiplication_2,
    Exponent=0,
    Cutoff=100,
    AngleRange=0)
kangaroo_settings = KangarooSettings(
    Tolerance=0.001,
    TimeStep=0.01,
    SubIterations=100,
    Floor=False,
    Drag=1,
    Restitution=0.7,
    StaticFriction=10,
    KineticFriction=10,
    Settle=2,
    Tumble=1,
    Sound=False,
    Solver=0)
kangaroo = KangarooPhysics(
    ForceObjects=flatten([align_2, springs, align_3, bend, align, anchorxyz, particle]),
    Settings=kangaroo_settings,
    Geometry=crv_5,
    SimulationReset=Button())  # -> Out, Iterations, ParticlesOut, GeometryOut
